# Grasshopper definition 1.The Maxima-03282021.gh (Grasshopper 1.0.7)
# plug-ins: Pufferfish, Human

# ---- group: Import your site here
site = Curve(<curve referenced from the Rhino model>)

# ----
area = Area(Geometry=site)  # -> Area, Centroid

# ---- group: re-orient bldg
number_slider = Slider(0, range=0..360)
rotate = Rotate(Geometry=site, Angle=degrees(number_slider), Plane=area.Centroid)  # -> Geometry, Transform

# ----
# Density of grid, smaller grid, higher precision.
number_slider_2 = Slider(2, range=1..10)

# ---- group: Major component here
maximal_rectangle = GhPythonScript(site=rotate.Geometry, density=number_slider_2)  # -> out, rects_inside, rects_outside, all_rects, is_inside_flatten, loc, top_bound, corners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; inputs site: Polyline, density: Int32
# ---------- maximal_rectangle: Python ----------
__author__ = "yanga"
__version__ = "2021.03.21"

import rhinoscriptsyntax as rs
import Rhino.Geometry as rg
import Rhino.RhinoDoc as rc
import math
import random

tolerance = 0.25

# building the site crv to bounding box
def convert_to_bbox(crv):
    return rg.BoundingBox(crv.ToArray())

# get unique edges and lengths of the bbox
def get_edges(bbox):
    all_edges = bbox.GetEdges()
    unique_edges = [all_edges[0], all_edges[1]]
    edge_lengths = (unique_edges[0].Length, unique_edges[1].Length)
    return unique_edges, edge_lengths

# create rectangle
def create_rect(pt_1, density):
    # pt_1 is the bottom left corner
    pt_2 = rg.Point3d(pt_1.X + density, pt_1.Y, 0)
    pt_3 = rg.Point3d(pt_2.X, pt_2.Y + density, 0)
    pt_4 = rg.Point3d(pt_3.X - density, pt_3.Y, 0)
    rect = rg.Polyline([pt_1, pt_2, pt_3, pt_4, pt_1])
    next_og_pt = pt_2
    return rect, next_og_pt

# create a grid overlay from the bbox
def create_grid(unique_edges, edge_lengths):
    # get the starting corner point
    og_pt = rg.Line.PointAt(unique_edges[0], 0)
    og_pt_x = og_pt.X
    og_pt_y = og_pt.Y
    # get x and y direction steps
    x_num = int(edge_lengths[0] / density)
    y_num = int(edge_lengths[1] / density)
    grids = []
    for i in range(y_num+1):
    # for every rectangle along X axis
        col_grids = []
        for j in range(x_num+1):
        # for every rectangle along Y axis
            new_rect, new_og_pt = create_rect(og_pt, density)
            og_pt = new_og_pt
            col_grids.append(new_rect)
        og_pts = col_grids[0].ToArray()
        og_pt = og_pts[3]
        grids.append(col_grids)
    
    return grids

def is_rect_inside_site(grid, site):
    # return 0 if the rectangle is inside the site boundary
    # return 1 if the rectangle is outside the site boundary
    cnts = []
    is_inside = []
    inside_rects = []
    outside_rects = []
   
    for col_rect in grid:
        row = []
        for row_rect in col_rect:
            # get the cnt point for each rect
            area = rg.AreaMassProperties.Compute(rg.PolylineCurve(row_rect))
            cnt = area.Centroid
            cnts.append(cnt)
            ray = rg.Line(cnt, rg.Point3d(cnt.X + 1000, cnt.Y, 0))
            site_crv = site.ToNurbsCurve()
            ray_crv = ray.ToNurbsCurve()
            int = rg.Intersect.Intersection.CurveCurve(site_crv, ray_crv, tolerance, tolerance).Count
            # if the number of intersection event per ray is even number including 0, it means
            # the rectangle is outside, otherwise, it is inside.
            if int % 2 != 0:
                inside_rects.append(row_rect)
                row.append(1)
            else:
                outside_rects.append(row_rect)
                row.append(0)
        is_inside.append(row)
    return inside_rects, outside_rects, cnts, is_inside

def rect_area(is_inside):
    row, col = len(is_inside), len(is_inside[0])
    top_bound = [[0 for j in range(col)] for i in range(row + 1)]
    left_bound = [[0 for j in range(col)] for i in range(row + 1)]
    right_bound = [[col - 1 for j in range(col)] for i in range(row + 1)]
    
    # the following code constructs the logic
    for r in range(0, row):
        lb = 1
        for c in range(col):
            if is_inside[r][c] == 1:
                top_bound[r][c] = top_bound[r-1][c] + 1
                left_bound[r][c] = max(lb, left_bound[r-1][c])
            else:
                lb = c + 1
        rb = col - 1
        for c in range(col-1, -1, -1):
            if is_inside[r][c] == 1:
                right_bound[r][c] = min(rb, right_bound[r-1][c])
            else:
                rb = c - 1
    
    # the following code finds out the corner points
    max_area = 0
    for i in range(row):
        for j in range(col):
            if is_inside[i][j] == 1:
                # look at each grid, if it is 1, find out its right and left bound
                # number, the number indicate its maximum length in left and right and height
                # area = (r - l) * h
                cur_area = (right_bound[i][j] - left_bound[i][j] + 1) * top_bound[i][j]
                
                # once if the max_area is less than the latest current area, then replace
                # the max_area with the cur_area, and find out the corresponding corner.
                if max_area < cur_area:
                    #pt_0
                    right_cor = [i, right_bound[i][j]-1]
                    #pt_1
                    left_cor = [i, left_bound[i][j]]
                    height_dist = top_bound[i][j] - 1
                    #pt_2
                    top_right = [i - height_dist, right_bound[i][j]-1]
                    #pt_3
                    top_left = [i - height_dist, left_bound[i][j]]
                    results_area = [right_cor, left_cor, top_right, top_left]
                    max_area = cur_area
    
    # find out the coordinate of each corner
    pt_1 = results_area[0]
    pt_2 = results_area[1]
    pt_3 = results_area[2]
    pt_4 = results_area[3]
    
    # take out the pad row and pad column for each bound
    top_bound.pop(0)
    right_bound.pop(0)
    left_bound.pop(0)
    
    return pt_1, pt_2, pt_3, pt_4, top_bound, right_bound, left_bound


# run
bbox = convert_to_bbox(site)
# get the edges of the bounding box of the site
unique_edges, edge_lengths = get_edges(bbox)
# get the grid over lay on the site
grid = create_grid(unique_edges, edge_lengths)
# flatten the grid nested list, rhino does not work with nested list
grid_flatten = [rect for col in grid for rect in col]

# if you need to visualize some of the current results
# is_inside is the grid of 1 and 0, 1 means inside, 0 means outside
inside_rects, outside_rects, cnts, is_inside = is_rect_inside_site(grid, site)

rects_inside = inside_rects
rects_outside = outside_rects
all_rects = grid_flatten
loc = cnts
is_inside_flatten = [num for col in is_inside for num in col]

# important results, four corner points of the maximal rectangle
# also the three different bounds, shwo each of them to find the logic why they are made.
pt1, pt2, pt3, pt4, top_bound, right_bound, left_bound = rect_area(is_inside)



# the lines below should be very apparent for you, these are the results you need.
top_r = grid[pt1[0]][pt1[1]]
top_l = grid[pt2[0]][pt2[1]]
bot_l = grid[pt3[0]][pt3[1]]
bot_r = grid[pt4[0]][pt4[1]]

corners = [top_r, top_l, bot_l, bot_r]
top_bound = [num for col in top_bound for num in col]
right_bound = [num for col in right_bound for num in col]
left_bound = [num for col in left_bound for num in col]
# ---------- end maximal_rectangle ----------

# ----
bbox = BoundingBox(Content=maximal_rectangle.corners, Plane=PlaneXY(0, 0, 0), UnionBox=True)  # -> Box, Box_2

# ---- group: Architectural elements
debox = DeconstructBox(Box=bbox.Box)  # -> Plane, X, Y, Z
rectangle = Rectangle(Plane=debox.Plane, XSize=debox.X, YSize=debox.Y, Radius=0)  # -> Rectangle, Length
series = Series(Start=0, Step=Slider(5, range=0..100), Count=Slider(5, range=0..10))
Z = UnitZ(Factor=series)
move = Move(Geometry=rectangle.Rectangle, Motion=Z)  # -> Geometry, Transform
Z_2 = UnitZ(Factor=Slider(0.503, range=0..10))
boundary = BoundarySurfaces(Edges=move.Geometry)
offsrf = OffsetSurface(Surface=boundary, Distance=Z_2, BothSides=False, CreateSolid=True)  # -> flatten(Offset)
bbox_2 = BoundingBox(Content=offsrf, Plane=PlaneXY(0, 0, 0), UnionBox=True)  # -> Box, Box_2
debrep = DeconstructBrep(Brep=bbox_2.Box)  # -> Faces, Edges, Vertices
cull_i = CullIndex(List=offsrf, Indices=-1, Wrap=True)
crv = Curve(<curve referenced from the Rhino model>)
boundary_2 = BoundarySurfaces(Edges=crv)
re_oriented_architectural_elements = GhPythonScript(
    envelope_edge=debrep.Edges,
    envelope=bbox_2.Box,
    floors=cull_i,
    rotation=number_slider,
    site=boundary_2,
    site_cnt=area.Centroid,
    bldg_base=rectangle.Rectangle)  # -> out, floors, envelope, envelope_edge, bldg_base; inputs envelope_edge: list of Curve, envelope: list of Box, floors: list of Brep, site: Surface, site_cnt: Point3d, bldg_base: list of Curve
# ---------- re_oriented_architectural_elements: Python ----------
__author__ = "yangyankun"
__version__ = "2021.03.28"

import rhinoscriptsyntax as rs
import Rhino.Geometry as rg
import Rhino.RhinoMath as m


def move_stuff(geos, site, site_cnt, rotation):
    
    # get plane
    vec = rg.Vector3d(0,0,1)
    site_loc = rg.Plane(site_cnt, vec)
    site_loc_og = site_loc.Clone()
    rad = m.ToRadians(rotation)
    site_loc.Rotate(rad, vec, site_cnt)
    
    # move every elements to the site
    for geo in geos:
        trans = rg.Transform.PlaneToPlane(site_loc,site_loc_og)
        geo.Transform(trans)
    return geos

# run
floors = move_stuff(floors, site, site_cnt, rotation)
envelope = move_stuff(envelope, site, site_cnt, rotation)
envelope_edge = move_stuff(envelope_edge, site, site_cnt, rotation)
bldg_base = move_stuff(bldg_base, site, site_cnt, rotation)
# ---------- end re_oriented_architectural_elements ----------

# ---- group: Trees
offset = OffsetCurve(Curve=re_oriented_architectural_elements.bldg_base, Distance=Slider(2, range=0..10), Plane=PlaneXY(0, 0, 0), Corners=1)
rdiff = RegionDifference(CurvesA=crv, CurvesB=offset)
bbox_3 = BoundingBox(Content=rdiff, Plane=PlaneXY(0, 0, 0), UnionBox=True)  # -> Box, Box_2
pop2d = Populate2D(Region=bbox_3.Box, Count=100, Seed=1)
incurves = PointInCurves(Point=pop2d, Curves=rdiff)  # -> Relationship, Index, Point
boundary_3 = BoundarySurfaces(Edges=rdiff)
equals = Equality(FirstNumber=incurves.Relationship, SecondNumber="2")  # -> Equality, Inequality
dispatch = Dispatch(List=pop2d, DispatchPattern=equals.Equality)  # -> ListA, ListB
pt = Point(dispatch.ListA)
Z_3 = UnitZ(Factor=1)
line = LineSDL(Start=flatten(pt), Direction=Z_3, Length=Slider(2.8, range=0..10))
end = EndPoints(Curve=line)  # -> Start, End
msphere = MeshSphere(Base=end.End, Radius=Slider(0.656, range=0..10), UCount=10, VCount=20)

# ---- group: If you need this dash frame, this is it
frame = Curve(<curve referenced from the Rhino model>)
explode = Explode(Curve=frame, Recursive=True)  # -> Segments, Vertices
len = Length(Curve=explode.Segments)
divide = DivideCurve(Curve=explode.Segments, Count=Slider(18, range=0..100), Kinks=False)  # -> simplify(Points), Tangents, Parameters
item = ListItem(List=len, Index=0, Wrap=True)
N = Count(10)
division = Division(A=item, B=N)
subtraction = Subtraction(A=division, B=Slider(9.026, range=0..10))
python = GhPythonScript(pts=divide.Points, length=subtraction)  # -> out, dash, cross; inputs pts: tree of Point3d
# ---------- python: Python ----------
__author__ = "yanga"
__version__ = "2021.03.23"

import rhinoscriptsyntax as rs
import Rhino.Geometry as rg

n_branches = pts.BranchCount
all_pts = []
for n in range(n_branches):
    all_pts.append(pts.Branch(n))
dash = []
cross = []
counter = 0
for branch in all_pts:
    if counter % 2 == 0:
        w = rg.Interval(-length, length)
        l = rg.Interval(-(length/2), length/2)
    else:
        l = rg.Interval(-length, length)
        w = rg.Interval(-(length/2), length/2)
    counter += 1
    for i in range(1, len(branch)-1):
        vec = rg.Vector3d(0,0,1)
        plane = rg.Plane(branch[i], vec)
        dash.append(rg.Rectangle3d(plane, w, l))
    # cross
    A = rg.Line(rg.Point3d(branch[0].X + 2, branch[0].Y, 0), branch[0])
    B = rg.Line(rg.Point3d(branch[0].X - 2, branch[0].Y, 0), branch[0])
    C = rg.Line(rg.Point3d(branch[0].X, branch[0].Y + 2, 0), branch[0])
    D = rg.Line(rg.Point3d(branch[0].X, branch[0].Y - 2, 0), branch[0])
    cross.append([A,B,C,D])

cross = [i for j in cross for i in j]
# ---------- end python ----------
swatch = ColourSwatch(SwatchColor=RGB(0, 0, 0))
boundary_4 = BoundarySurfaces(Edges=python.dash)
previewlw = CustomPreviewLineweights(Geometry=[python.dash, python.cross], Shader=swatch, Absolute=False)
preview = CustomPreview(Geometry=boundary_4, Material=swatch)

# ---- group: Visualization of all the bounds
crv_2 = Curve(maximal_rectangle.all_rects)
area_2 = Area(Geometry=crv_2)  # -> Area, Centroid
debrep_2 = DeconstructBrep(Brep=maximal_rectangle.bbox)  # -> Faces, Edges, Vertices
crv_3 = Curve(debrep_2.Edges)
previewlw_2 = CustomPreviewLineweights(Geometry=crv_3, Shader=ColourSwatch(SwatchColor=RGB(0, 0, 0)), Thickness=Slider(6, range=0..10), Absolute=False)
previewlw_3 = CustomPreviewLineweights(
    Geometry=rotate.Geometry,
    Shader=ColourSwatch(SwatchColor=RGB(0, 0, 0)),
    Thickness=Slider(3, range=0..10),
    Absolute=False)
is_inside = TextTag(Location=area_2.Centroid, Text=maximal_rectangle.is_inside_flatten, Colour=ColourSwatch(SwatchColor=RGB(0, 0, 0)))
top_bound = TextTag(Location=area_2.Centroid, Text=maximal_rectangle.top_bound_2, Colour=ColourSwatch(SwatchColor=RGB(0, 0, 0)))
right_bound = TextTag(Location=area_2.Centroid, Text=maximal_rectangle.right_bound, Colour=ColourSwatch(SwatchColor=RGB(0, 0, 0)))
left_bound = TextTag(Location=area_2.Centroid, Text=maximal_rectangle.left_bound, Colour=ColourSwatch(SwatchColor=RGB(0, 0, 0)))
top_bound_2 = TextTag(Location=maximal_rectangle.loc, Text=maximal_rectangle.top_bound, Colour=ColourSwatch(SwatchColor=RGB(0, 0, 0)))

# ---- group: Results visualization
preview_2 = CustomPreview(Geometry=boundary_3, Material=ColourSwatch(SwatchColor=RGB(0, 0, 0)))
preview_3 = CustomPreview(Geometry=msphere, Material=ColourSwatch(SwatchColor=RGB(255, 255, 255)))
preview_4 = CustomPreview(Geometry=re_oriented_architectural_elements.floors, Material=ColourSwatch(SwatchColor=RGB(255, 190, 84)))
preview_5 = CustomPreview(Geometry=re_oriented_architectural_elements.envelope, Material=ColourSwatch(SwatchColor=RGBA(204, 204, 204, 76)))
preview_6 = CustomPreview(Geometry=re_oriented_architectural_elements.envelope_edge, Material=ColourSwatch(SwatchColor=RGB(255, 255, 255)))
previewlw_4 = CustomPreviewLineweights(Geometry=line, Shader=ColourSwatch(SwatchColor=RGB(135, 135, 135)), Absolute=False)
previewlw_5 = CustomPreviewLineweights(Geometry=crv, Shader=ColourSwatch(SwatchColor=RGB(0, 0, 0)), Thickness=Slider(3, range=0..10), Absolute=False)
