# Grasshopper definition 2.The Multi Maxima-04062021.gh (Grasshopper 1.0.7)
# plug-ins: Pufferfish

# ---- group: sites
number_slider = Slider(36, range=0..100)
division = Division(A=1, B=number_slider)
site_2 = Curve(<curve referenced from the Rhino model>)
site_1 = Curve(<curve referenced from the Rhino model>)
series = Series(Start=0, Step=division, Count=number_slider)
tweencrv = TweenCurve(CurveA=site_1, CurveB=site_2, Factor=series, BlendType=0)

# ---- group: parameters
number_slider_2 = Slider(0, range=0..360)
weights_volume = Panel("""0.2
0.2
0.5""")
programs = Panel("""Program-1
Program-2
program-3""")

# ----
python = GhPythonScript(n_sites=number_slider, sites=flatten(tweencrv), orientation=number_slider_2)  # -> out, chosen_site; inputs n_sites: Int32, sites: list of Curve
# ---------- python: Python ----------
__author__ = "yanga"
__version__ = "2021.04.06"

import rhinoscriptsyntax as rs
import math

# this is for animatin only
# re-orientating the volumes meanwhile shrinking the given site
step_size = 360 / n_sites
site_ind = int(round(orientation / step_size))
if site_ind != 0:
    site_ind -= 1

chosen_site = sites[site_ind]
# ---------- end python ----------
site = GhPythonScript()  # -> out, site
# ---------- site: Python ----------
__author__ = "yanga"
__version__ = "2021.04.04"

import rhinoscriptsyntax as rs
import Rhino.Geometry as rg
import Rhino.RhinoDoc as rc
import math

# set up global tolerance
#tol = rc.ActiveDoc.ModelAbsoluteTolerance
tol = 0.25



class Site:
    
    # Site object and its methods.
    def __init__(self, site_boundary, density):
        self.site = site_boundary
        self.density = density
        self.site_bbox = self.convert_to_bbox()
        self.unique_edges, self.edge_lengths = self.get_bbox_edges(self.site_bbox)
        self.site_srf = self.create_site_srf()
    
    def create_site_srf(self):
        if type(self.site) is list:
            site_crvs = []
            for poly in self.site:
                crv = rg.PolylineCurve(poly)
                site_crvs.append(crv)
            srf = rg.Brep.CreatePlanarBreps(site_crvs)
        else:
            srf = rg.Brep.CreatePlanarBreps(self.site.ToNurbsCurve())
        return srf
    
    def convert_to_bbox(self):
        site_pts = []
        if len(self.site) >= 1:
            for site in self.site:
                site_pts.extend(site.ToArray())
        else:
            #print self.site
            site_pts.extend((self.site).ToArray())
        bbox = rg.BoundingBox(site_pts)
        return bbox
    
    def get_bbox_edges(self, bbox):
        all_edges = bbox.GetEdges()
        unique_edges = [all_edges[0], all_edges[1]]
        edge_lengths = unique_edges[0].Length, unique_edges[1].Length
        return unique_edges, edge_lengths
    
    def create_rect(self, og_pt):
        # pt_1 is the bottom left corner
        pt_1 = og_pt
        pt_2 = rg.Point3d(pt_1.X + self.density, pt_1.Y, 0)
        pt_3 = rg.Point3d(pt_2.X, pt_2.Y + self.density, 0)
        pt_4 = rg.Point3d(pt_3.X - self.density, pt_3.Y, 0)
        rect = rg.Polyline([pt_1, pt_2, pt_3, pt_4, pt_1])
        next_og_pt = pt_2
        return rect, next_og_pt
    
    def create_grid(self):
        grids = []
        # et the starting point at the bottom left corner
        og_pt = rg.Line.PointAt(self.unique_edges[0], 0)
        # get the X and Y coords of the og_pt
        og_pt_x = og_pt.X
        og_pt_y = og_pt.Y
        # get number of col and row of the grid
        x_num = int(self.edge_lengths[0] / self.density)
        y_num = int(self.edge_lengths[1] / self.density)
        
        for i in range(y_num + 1):
        # look at each column
            col_grids = []
            for j in range(x_num + 1):
                # look at each row
                new_rect, new_og_pt = self.create_rect(og_pt)
                og_pt = new_og_pt
                col_grids.append(new_rect)
            og_pts = col_grids[0].ToArray()
            og_pt = og_pts[3]
            grids.append(col_grids)
        return grids
        
    def is_rect_inside_site(self):
        # return 0 if the rectangle is inside the site boundary
        # return 1 if the rectangle is outside the site boundary
        self.rect_cnts = []
        self.is_inside = []
        self.inside_rects = []
        self.outside_rects = []
        for col_rect in self.grids:
            row = []
            for row_rect in col_rect:
                # get the rect_cnt for each rect
                area = rg.AreaMassProperties.Compute(rg.PolylineCurve(row_rect))
                cnt = area.Centroid
                self.rect_cnts.append(cnt)
                ray = rg.Line(cnt, rg.Point3d(cnt.X + 1000, cnt.Y, 0))
                total_intx = 0
                for site in self.site:
                    site_crv = site.ToNurbsCurve()
                    ray_crv = ray.ToNurbsCurve()
                    total_intx += rg.Intersect.Intersection.CurveCurve(site_crv, ray_crv, tol, tol).Count
                # if the number of intersection event per ray is even number including 0, it means
                # the rectangle is outside, otherwise, it is inside.
                if total_intx % 2 != 0:
                    self.inside_rects.append(row_rect)
                    row.append(1)
                else:
                    self.outside_rects.append(row_rect)
                    row.append(0)
            self.is_inside.append(row)
    
    def run(self):
        self.grids = self.create_grid()
        self.is_rect_inside_site()


site = Site
# ---------- end site ----------
max_rect = GhPythonScript()  # -> out, max_rect
# ---------- max_rect: Python ----------
__author__ = "yanga"
__version__ = "2021.04.04"

import rhinoscriptsyntax as rs
import Rhino.Geometry as rg
import Rhino.RhinoDoc as rc
import math

# set up global tolerance
tol = rc.ActiveDoc.ModelAbsoluteTolerance

# this is the Max_rect class that produces the colored boxes
class Max_rect:
    def __init__(self, is_inside, target_max_area, grid):
        self.is_inside = is_inside
        self.target_max_area = target_max_area
        self.grid = grid
        self.right_bound, self.left_bound, self.top_bound, self.row, self.col = self.max_rect_max_bound()
    
    def max_rect_max_bound(self):
        # find out the max envelope of the building
        # this is the main driver of the generation of the color boxes
        # this algorihm finds the left right top and bottom bounds
        # for each grid in the matrix, and stop looking once the target
        # is found. In this case, the target is the sqft area.
        row, col = len(self.is_inside), len(self.is_inside[0])
        top_bound = [[0 for j in range(col)] for i in range(row + 1)]
        left_bound = [[0 for j in range(col)] for i in range(row + 1)]
        right_bound = [[col - 1 for j in range(col)] for i in range(row + 1)]
        
        for r in range(0, row):
            lb = 1
            for c in range(col):
                if self.is_inside[r][c] == 1:
                    top_bound[r][c] = top_bound[r-1][c] + 1
                    left_bound[r][c] = max(lb, left_bound[r-1][c])
                else:
                    lb = c + 1
            rb = col - 1
            for c in range(col - 1, -1, -1):
                if self.is_inside[r][c] == 1:
                    right_bound[r][c] = min(rb, right_bound[r-1][c])
                else:
                    rb = c - 1
        return right_bound, left_bound, top_bound, row, col
    
    def max_rect(self):
        # find out the four corner points of the max bldg
        max_area = 0
        results_area = []
        for i in range(self.row):
            for j in range(self.col):
                if self.is_inside[i][j] == 1:
                    # height
                    height_dist = self.top_bound[i][j] - 1 
                    # pt_0
                    right_cor = [i, self.right_bound[i][j] - 1]
                    # pt_1
                    left_cor = [i, self.left_bound[i][j]]
                    # pt_2
                    top_right = [i - height_dist, self.right_bound[i][j] - 1]
                    #pt_3
                    top_left = [i - height_dist, self.left_bound[i][j]]
                    cur_max_rect_footprint = self.max_rect_footprint(right_cor, left_cor, top_right, top_left)
                    cur_area = rg.AreaMassProperties.Compute(rg.PolylineCurve(cur_max_rect_footprint)).Area
                    if max_area <= cur_area and max_area <= self.target_max_area:
                        results_area = [right_cor, left_cor, top_right, top_left]
                        max_area = cur_area
        # find out the corner coordintes
        pt_1 = results_area[0]
        pt_2 = results_area[1]
        pt_3 = results_area[2]
        pt_4 = results_area[3]
        
        # take out the pad row and pad column out for each bound
        self.top_bound.pop(0)
        self.right_bound.pop(0)
        self.left_bound.pop(0)
        
        return pt_1, pt_2, pt_3, pt_4
    
    def max_rect_footprint(self, pt_1, pt_2, pt_3, pt_4):
        # this function returns the footprint, not useful when I
        # realize this is actually an unecessary method :(
        top_r = self.grid[pt_1[0]][pt_1[1]]
        top_l = self.grid[pt_2[0]][pt_2[1]]
        bot_l = self.grid[pt_3[0]][pt_3[1]]
        bot_r = self.grid[pt_4[0]][pt_4[1]]
        rects = [top_r, top_l, bot_l,bot_r]
        pts = []
        for rect in rects:
            pts.append(rect.ToArray())
        pts = [i for pt in pts for i in pt]
        bldg = rg.BoundingBox(pts)
        corners = list(bldg.GetCorners()[:4])
        corners_start = corners[0]
        corner_lst = corners
        corner_lst.append(corners_start)
        footprint = rg.Polyline(corner_lst)
        return footprint

max_rect = Max_rect
# ---------- end max_rect ----------
site_3 = Curve(python.chosen_site)
generator = GhPythonScript(
    max_rect=max_rect.max_rect,
    site=site.site,
    site_poly=site_3,
    density=Slider(3, range=0..10),
    weights=weights_volume,
    orientation=number_slider_2,
    programs=programs)  # -> out, results, cols, grids, sites, is_inside; inputs site_poly: list of Polyline, weights: list, programs: list
# ---------- generator: Python ----------
__author__ = "yanga"
__version__ = "2021.04.04"

import Rhino.Geometry as rg
import Rhino.RhinoDoc as rc
import copy
import math

# set up global tolerance
tol = rc.ActiveDoc.ModelAbsoluteTolerance

class Generate:
    
    # generator class, it mainly runs to call both max_rect and site classes to generate
    # the desired boxes
    def __init__(self, site_poly, density, site, max_rect, orientation, weights):
        self.site_poly = site_poly
        self.site_poly_og = copy.deepcopy(rg.PolylineCurve(site_poly[0]))
        self.density = density
        self.max_rect = max_rect
        self.site = site
        self.orientation = orientation
        self.weights = weights
        self.max_rects = []
        self.is_inside_all = []
        self.site_polies = []
        self.grids = []
    
    # run once per call to initialize the site object
    def initiate_design(self):
        rad = math.radians(self.orientation)
        site_poly_cnt = rg.AreaMassProperties.Compute(rg.PolylineCurve(self.site_poly[0])).Centroid
        rotation = rg.Transform.Rotation(rad, rg.Vector3d.ZAxis, site_poly_cnt)
        self.site_poly[0].Transform(rotation)
        self.site_polies.append([self.site_poly[0]])
        self.cur_site_srf = rg.Brep.CreatePlanarBreps(rg.PolylineCurve(self.site_poly[0]), tol)
        self.cur_site = self.site(self.site_poly, self.density)
        
    def display_grid(self, site):
        grid = [rect for col in site.grids for rect in col]
        return grid
    
    def choose_site(self, sites):
        # choose the max area site
        # It can be anything, really, I chose to get the maximum site, but perhaps you don't
        # want that way. Why choose site? because everytime a box is generated, we want to
        # know what the left over space there is, and choose the biggest one to grow the next
        # box.
        max_area = 0
        chosen_site = None
        for site in sites:
            site_area = rg.AreaMassProperties.Compute(site).Area
            if site_area > max_area:
                chosen_site = site
                max_area = site_area
        return chosen_site
    
    def substract_site(self, site_poly, max_rect_footprint):
        # Once we get one box generated, we immediately substract the site with the footprint
        # of the box, so that future boxes don't collide into the already generated boxes.
        site_breps = []
        max_rect_footprint = rg.PolylineCurve(max_rect_footprint)
        max_rect_footprint_brep = rg.Brep.CreatePlanarBreps(max_rect_footprint, 0.01)
        site_crvs = [rg.PolylineCurve(site) for site in site_poly]
        site_brep = rg.Brep.CreatePlanarBreps(site_crvs, 0.01)
        difference = rg.Brep.CreateBooleanDifference(site_brep[0], max_rect_footprint_brep[0], 0.01, 0.01)
        if difference:
            chosen_site_brep = self.choose_site(difference)
        else:
            chosen_site_brep = None
        return chosen_site_brep
    
    def reorientation(self, geos, site, site_cnt, rotation):
        # simply this method is to just get the site re-orientating in different direction..
        # get plane
        vec = rg.Vector3d(0,0,1)
        site_loc = rg.Plane(site_cnt, vec)
        site_loc_og = site_loc.Clone()
        rad = math.radians(self.orientation)
        site_loc.Rotate(rad, vec, site_cnt)
        # move every elements to the site
        for geo in geos:
            trans = rg.Transform.PlaneToPlane(site_loc,site_loc_og)
            geo.Transform(trans)
        return geos
    
    def generate(self):
        # abviously, this method is to generate the boxes in a recursive loop.
        self.initiate_design()
        max_iter = len(self.weights)
        steps = 0
        count = 0
        while count < max_iter and steps <= 100:
            self.cur_site.run()
            self.grids.append(self.display_grid(self.cur_site))
            is_inside = self.cur_site.is_inside
            self.is_inside_all.append(is_inside)
            grid = self.cur_site.grids
            target_max_area = rg.AreaMassProperties.Compute(self.cur_site_srf).Area * self.weights[count]
            cur_max_rect = self.max_rect(is_inside,target_max_area, grid)
            pt_1, pt_2, pt_3, pt_4 = cur_max_rect.max_rect()
            cur_max_rect_footprint = cur_max_rect.max_rect_footprint(pt_1, pt_2, pt_3, pt_4)
            self.max_rects.append(cur_max_rect_footprint)
            # split site
            chosen_site_brep = self.substract_site(self.cur_site.site, cur_max_rect_footprint)
            if not chosen_site_brep:
                break
            else:
                self.cur_site_srf = chosen_site_brep
                chosen_site_poly = rg.Brep.CreateContourCurves(chosen_site_brep, rg.Plane.WorldXY)
                chosen_site_poly = [site_poly.ToPolyline() for site_poly in chosen_site_poly]
                self.site_polies.append(chosen_site_poly)
                self.cur_site = self.site(chosen_site_poly, self.density)
            steps += 1
            count += 1

generate = Generate(site_poly, density, site, max_rect, orientation, weights)
generate.generate()
# this is the results
results = generate.max_rects
# this is the original site center, the un-substracted site.
site_cnt_og = rg.AreaMassProperties.Compute(generate.site_poly_og).Centroid
generate.reorientation(results, generate.site_poly_og, site_cnt_og, generate.orientation)
# sort the boxes from large to small
results.sort(key=lambda x:rg.AreaMassProperties.Compute(rg.PolylineCurve(x)).Area, reverse=True)
# this is the matrix of 1 and 0 that shows whether the boxes inside the site or not.
is_inside = generate.is_inside_all
grids = generate.grids
sites = generate.site_polies
col_base = 0
cols = []
for i in range(len(programs)):
    col_base += 1 / len(programs)
    cols.append(col_base)
# ---------- end generator ----------
crv = Curve(generator.results)
boundary = BoundarySurfaces(Edges=crv)
Z = UnitZ(Factor=Slider(23, range=0..300))
offsrf = OffsetSurface(Surface=boundary, Distance=Z, BothSides=False, CreateSolid=True)  # -> flatten(Offset)

# ---- group: visualization
number_slider_3 = Slider(0, range=0..3)
boundary_2 = BoundarySurfaces(Edges=site_3)
item = ListItem(List=generator.results, Index=number_slider_3, Wrap=True)
item_2 = ListItem(List=generator.sites, Index=number_slider_3, Wrap=True)
item_3 = ListItem(List=generator.is_inside, Index=number_slider_3, Wrap=True)
item_4 = ListItem(List=generator.grids, Index=number_slider_3, Wrap=True)
python_2 = GhPythonScript(is_inside=item_3, grids=item_4, og_sites=item_2)  # -> out, all_grids, is_inside, site; inputs is_inside: list, grids: list, og_sites: list
# ---------- python_2: Python ----------
__author__ = "yanga"
__version__ = "2021.04.06"

import rhinoscriptsyntax as rs
import Rhino.Geometry as rg
is_inside = [sth for something in is_inside[0] for sth in something]
all_grids = []
for grid in grids:
    for poly in grid:
        all_grids.append(poly.ToNurbsCurve())

site = []
for polies in og_sites:
    for poly in polies:
        site.append(poly)
# ---------- end python_2 ----------
preview = CustomPreview(
    Geometry=offsrf,
    Material=[ColourSwatch(SwatchColor=RGBA(0, 102, 255, 132)), ColourSwatch(SwatchColor=RGBA(0, 246, 255, 115)), ColourSwatch(SwatchColor=RGBA(255, 30, 0, 107))])
preview_2 = CustomPreview(Geometry=boundary_2, Material=ColourSwatch(SwatchColor=RGB(0, 0, 0)))
bbox = BoundingBox(Content=python_2.all_grids, Plane=PlaneXY(0, 0, 0), UnionBox=True)  # -> Box, Box_2; disabled
crv_2 = Curve(python_2.site)  # disabled
split = SplitBrep(Brep=bbox.Box, Cutter=python_2.all_grids)  # disabled
item_5 = ListItem(List=split, Index=0, Wrap=True)  # -> flatten(Item); disabled
area = Area(Geometry=item_5)  # -> Area, Centroid; disabled
tag = TextTag(Location=area.Centroid, Text=python_2.is_inside)  # disabled

# ---- group: tree
bbox_2 = BoundingBox(Content=boundary_2, Plane=PlaneXY(0, 0, 0), UnionBox=True)  # -> Box, Box_2
offsrf_2 = OffsetSurface(Surface=boundary_2, Distance=10, BothSides=False, CreateSolid=True)
pop2d = Populate2D(Region=bbox_2.Box, Count=Slider(100, range=0..100), Seed=1)
brepinc = PointInBrep(Brep=offsrf_2, Point=pop2d, Strict=False)  # -> simplify(Inside)
dispatch = Dispatch(List=pop2d, DispatchPattern=brepinc)  # -> ListA, ListB
pt = Point(dispatch.ListA)
brepsinc = PointInBreps(Brep=offsrf, Point=pt, Strict=False)  # -> Inside, Index
dispatch_2 = Dispatch(List=pt, DispatchPattern=brepsinc.Inside)  # -> ListA, ListB
line = LineSDL(Start=dispatch_2.ListB, Direction=Vector(0, 0, 1), Length=Slider(10, range=0..10))
end = EndPoints(Curve=line)  # -> Start, End
pt_2 = Point(end.End)
msphere = MeshSphere(Base=pt_2, Radius=Slider(3.5, range=0..10), UCount=10, VCount=20)

# ----
preview_3 = CustomPreview(Geometry=[msphere, line], Material=ColourSwatch(SwatchColor=RGB(255, 255, 255)))
