# Grasshopper definition 3. The Network - 04292021.gh (Grasshopper 1.0.7)
# plug-ins: Human

crv = Curve(<curve referenced from the Rhino model>)
area = Area(Geometry=crv)  # -> Area, Centroid
num_of_things = Slider(20, range=7..30)
start = Panel("3")
goal = Panel("6")

# ---- group: Set the canvas white, Ignore the error
swatch = ColourSwatch(SwatchColor=RGB(255, 255, 255))
canvas = GhPythonScript(switcher=Toggle(True), canvas_back=swatch, canvas_grid=swatch)  # -> out, a; inputs switcher: Boolean, canvas_back: Color, canvas_grid: Color
# ---------- canvas: Python ----------
__author__ = "yanga"
__version__ = "2021.04.28"

import rhinoscriptsyntax as rs
import Grasshopper as gh

if switcher == True:
    gh.GUI.Canvas.GH_Skin.canvas_grid = canvas_grid
    gh.GUI.Canvas.GH_Skin.canvas_back = canvas_back
    gh.GUI.Canvas.GH_Skin.canvas_edge = Color.FromArgb(255, 0, 0, 0)
    gh.GUI.Canvas.GH_Skin.canvas_shade = Color.FromArgb(80, 0, 0, 0)
else:
    gh.GUI.Canvas.GH_Skin.canvas_grid = Color.FromArgb(30, 0, 0, 0)
    gh.GUI.Canvas.GH_Skin.canvas_back = Color.FromArgb(255, 212, 208, 200)
    gh.GUI.Canvas.GH_Skin.canvas_edge = Color.FromArgb(255, 0, 0, 0)
    gh.GUI.Canvas.GH_Skin.canvas_shade = Color.FromArgb(80, 0, 0, 0)
# ---------- end canvas ----------

# ----
pt = Point(<point referenced from the Rhino model>)
swatch_2 = ColourSwatch(SwatchColor=RGB(0, 0, 0))
number_slider = Slider(8, range=0..10)
swatch_3 = ColourSwatch(SwatchColor=RGB(255, 115, 115))
swatch_4 = ColourSwatch(SwatchColor=RGB(255, 255, 255))

# ---- group: Frame4
number_slider_2 = Slider(360, range=0..360)
division = Division(A=number_slider_2, B="7.5")
panel = Panel(division)

# ----
rotate = Rotate(Geometry=crv, Angle=degrees(number_slider_2), Plane=area.Centroid)  # -> Geometry, Transform
pop2d = Populate2D(Region=rotate.Geometry, Count=num_of_things, Seed=1)
network = GhPythonScript(pts=pop2d, start=start, goal=goal)  # -> out, pts_ids, simplify(sel_lines), path, simplify(history), path_id; inputs pts: list of Point3d, start: Int32, goal: Int32
# ---------- network: Python ----------
__author__ = "yanga"
__version__ = "2021.04.26"

import rhinoscriptsyntax as rs
import Rhino.Geometry as rg
import ghpythonlib.treehelpers as th
import random

random.seed(0)

# create Node object
class Node:
    def __init__(self, pt, id):
        self.id = id
        self.pt = pt
        self.x = self.pt.X
        self.y = self.pt.Y
        self.z = self.pt.Z
        self.neighbors = []
    
    def __repr__(self):
        return str(self.id)
    
    # add new neighboring node
    def add_neighbor(self, new_node):
        self.neighbors.append(new_node)
    
    # updating the relations between the current node and new nod
    def update_neighbor(self, new_node):
        self.add_neighbor(new_node)
        new_node.add_neighbor(self)

class Graph:
    def __init__(self, pts):
        self.pts = pts
        self.all_nodes = self.create_nodes()
        self.update_nodes_graph()
    
    def __repr__(self):
        return "Graph of " + str(len(self.pts)) + " nodes"
    
    # convert all points to be node objects
    def create_nodes(self):
        all_nodes = []
        for id in range(len(self.pts)):
            parent_node = node(self.pts[id], id)
            all_nodes.append(parent_node)
        return all_nodes
    
    # calculate the edge lengths
    def distance_pt_pts(self):
        dist = {}
        for outter_id in range(len(self.pts)):
            key = outter_id
            dist[key] = {}
            counter_id = 1
            for counter_id in range(len(self.pts)):
                length = rg.Line(self.pts[outter_id], self.pts[counter_id]).Length
                if length == 0:
                    continue
                else:
                    dist[key][counter_id] = length
        return dist
    
    # establishing a index graph structure
    def create_graph(self):
        dist = self.distance_pt_pts()
        sel_idx = []
        # for every element in the list, find its nearest 1,2,or 3 neighboring elements.
        # append them in sel_idx list
        for i in dist:
            cur_dist = dist[i].items()
            cur_dist.sort(key=lambda x: x[1])
            n_neighbors = random.randint(1,3)
            sel_idx.append([i, cur_dist[:n_neighbors]])
        self.pts_ids = [i for i in range(len(self.pts))]
        return sel_idx
    
    # establish node graph
    # for each node and its neighbors, update their relations with each other
    def update_nodes_graph(self):
        graph_lsts = self.create_graph()
        for lst in graph_lsts:
            parent_node = self.all_nodes[lst[0]]
            for sub_lst in lst[1:][0]:
                sub_idx = sub_lst[0]
                sub_node = self.all_nodes[sub_idx]
                if sub_node not in parent_node.neighbors:
                    parent_node.update_neighbor(sub_node)
    
    # create edges among nodes, this records their distance, positions
    # actual relations
    def update_edges(self):
        edges = []
        lines = []
        for node in self.all_nodes:
            for neighbor in node.neighbors:
                combo_nodes = {node.id, neighbor.id}
                if combo_nodes not in lines:
                    lines.append(combo_nodes)
                    edges.append([node.id, neighbor.id])
        return lines, edges
    
    # Breadth First Search algorithm, this is one of examples to realise this algorithm.
    # maxIter is a safety control, it avoids any situation that drags the code in indefinite loop in case
    # the code is written incorrectly.
    def BFS(self, start, goal):
        # get a queue list to store all paths to visit
        queue = []
        history = [[start.id]]
        # initiate by adding the start as the first path in queue
        queue.append([start])
        maxIter = 1000
        step = 0
        while queue and step < maxIter:
            # get the first path from queue
            path = queue.pop(0)
            node_to_visit = path[-1]
            if node_to_visit == goal:
                path_id = [path]
                return [i.pt for i in path], history, path_id
            for neighbor in node_to_visit.neighbors:
                new_path = list(path)
                new_path.append(neighbor)
                temp = []
                history.append([int(i.id) for i in new_path])
                queue.append(new_path)
            step += 1


# instantiate the node object
node = Node
# instantiate the graph object with the input points
graph = Graph(pts)
# create graph
graph.create_graph()

pts_ids = graph.pts_ids

all_nodes = graph.all_nodes

_, sel_lines = graph.update_edges()
# convert the nested list to GH tree
sel_lines = th.list_to_tree(sel_lines)
# cast the Breadth First Searching algorithm
path, history, path_id = graph.BFS(all_nodes[start], all_nodes[goal])

# the history of searching target
history = th.list_to_tree(history)

path_id = [node.id for node in path_id[0]]
# ---------- end network ----------
cir = Circle(Plane=pop2d, Radius=Slider(3, range=0..10))
item = ListItem(List=pop2d, Index=network.sel_lines, Wrap=True)
pt_2 = Point(network.path)
pline = PolyLine(Vertices=item, Closed=False)  # -> flatten(Polyline)
pline_2 = PolyLine(Vertices=pt_2, Closed=False)
boundary = BoundarySurfaces(Edges=cir)
panel_2 = Panel(network.sel_lines)
lng = ListLength(List=flatten(network.sel_lines))  # -> expr("x/2", Length)
series = Series(Start=0, Step=Slider(4.79, range=0..10), Count=lng)
python = GhPythonScript(pairs=panel_2)  # -> out, flatten(new_tree); inputs pairs: tree of Int32
# ---------- python: Python ----------
__author__ = "yanga"
__version__ = "2021.04.28"

import rhinoscriptsyntax as rs
import ghpythonlib.treehelpers as th

new_tree = []

count = pairs.BranchCount
for i in range(count):
    combo = pairs.Branch(i)
    new_tree.append(["Node " + str(combo[0]) + " <--------> " + "Node " + str(combo[1])])

new_tree = th.list_to_tree(new_tree)
# ---------- end python ----------
Y = UnitY(Factor=expr("-x", series))
move = Move(Geometry=pt, Motion=Y)  # -> Geometry, Transform

# ---- group: Frame4 (continued)
branch = TreeBranch(Tree=network.history, Path=division, MaintainPaths=True)
item_2 = ListItem(List=pop2d, Index=branch, Wrap=True)
pline_3 = PolyLine(Vertices=item_2, Closed=False)
item_3 = ListItem(List=python.new_tree, Index=branch, Wrap=True)
item_4 = ListItem(List=move.Geometry, Index=branch, Wrap=True)
tag = TextTag3D(
    Location=item_4,
    Text=item_3,
    Size=ColourSwatch(SwatchColor=RGB(255, 255, 255)),
    Colour=ColourSwatch(SwatchColor=RGB(255, 115, 115)),
    Justification=1)

# ---- group: Frame2
rec = DataRecorder(Slider(14, range=0..14), DataLimit=-10, RecordData=True)
item_5 = ListItem(List=pop2d, Index=rec, Wrap=True)
item_6 = ListItem(List=network.pts_ids, Index=rec, Wrap=True)
swatch_5 = ColourSwatch(SwatchColor=RGB(255, 255, 255))
tag_2 = TextTag3D(Location=item_5, Text=item_6, Size=swatch_5, Colour=swatch_5, Justification=5)

# ---- group: fame3
rec_2 = DataRecorder(Slider(18, range=0..18), DataLimit=-10, RecordData=True)
item_7 = ListItem(List=pline, Index=rec_2, Wrap=True)
item_8 = ListItem(List=python.new_tree, Index=rec_2, Wrap=True)
item_9 = ListItem(List=move.Geometry, Index=rec_2, Wrap=True)
swatch_6 = ColourSwatch(SwatchColor=RGB(255, 255, 255))
cluster = Cluster_2(V=item_9)
tag_3 = TextTag3D(Location=item_9, Text=item_8, Size=swatch_6, Colour=swatch_6, Justification=1)
previewlw = CustomPreviewLineweights(Geometry=item_7, Shader=ColourSwatch(SwatchColor=RGB(0, 0, 0)), Thickness=Slider(1, range=0..10), Absolute=False)

# ---- group: Frame1
rec_3 = DataRecorder(Slider(14, range=0..14), DataLimit=-10, RecordData=True)
item_10 = ListItem(List=boundary, Index=rec_3, Wrap=True)
preview = CustomPreview(Geometry=item_10, Material=ColourSwatch(SwatchColor=RGB(0, 0, 0)))

# ----
item_11 = ListItem(List=boundary, Index=[start, goal], Wrap=True)
preview_2 = CustomPreview(Geometry=item_11, Material=ColourSwatch(SwatchColor=RGB(153, 0, 0)))
tag_4 = TextTag3D(
    Location=flatten(move.Geometry),
    Text=flatten(python.new_tree),
    Size=ColourSwatch(SwatchColor=RGB(255, 255, 255)),
    Colour=ColourSwatch(SwatchColor=RGB(255, 255, 255)),
    Justification=1)
previewlw_2 = CustomPreviewLineweights(Geometry=pline, Shader=swatch_2, Absolute=False)
previewlw_3 = CustomPreviewLineweights(Geometry=pline_2, Shader=swatch_3, Thickness=number_slider, Absolute=False)
cluster_2 = Cluster(V=move.Geometry)
preview_3 = CustomPreview(Geometry=boundary, Material=swatch_2)
tag_5 = TextTag3D(Location=pop2d, Text=network.pts_ids, Size=swatch_4, Colour=swatch_4, Justification=5)
previewlw_4 = CustomPreviewLineweights(Geometry=pline_3, Shader=swatch_3, Thickness=number_slider, Absolute=False)

# ==== cluster Cluster
V = ClusterInput()
pline = PolyLine(Vertices=V, Closed=False)
X = UnitX(Factor=Slider(6.33, range=0..10))
move = Move(Geometry=pline, Motion=expr("-x", X))  # -> Geometry, Transform
offset = OffsetCurve(Curve=move.Geometry, Distance=expr("-x", Slider(40, range=0..100)), Plane=PlaneXY(0, 0, 0), Corners=1)
crv = Curve([offset, move.Geometry])
explode = Explode(Curve=flatten(crv), Recursive=True)  # -> Segments, Vertices
item = ListItem(List=explode.Vertices, Index=0, Wrap=True)  # -> flatten(Item)
item_2 = ListItem(List=explode.Vertices, Index=-1, Wrap=True)  # -> flatten(Item)
number_slider = Slider(8.332, range=0..10)
pline_2 = PolyLine(Vertices=item, Closed=False)
pline_3 = PolyLine(Vertices=item_2, Closed=False)
Y = UnitY(Factor=number_slider)
Y_2 = UnitY(Factor=number_slider)
move_2 = Move(Geometry=pline_3, Motion=expr("-x", Y_2))  # -> Geometry, Transform
move_3 = Move(Geometry=pline_2, Motion=Y)  # -> Geometry, Transform
crv_2 = Curve(flatten([move_3.Geometry, move_2.Geometry, crv]))
bbox = BoundingBox(Content=crv_2, Plane=PlaneXY(0, 0, 0), UnionBox=True)  # -> Box, Box_2
preview = CustomPreview(Geometry=bbox.Box, Material=ColourSwatch(SwatchColor=RGB(0, 0, 0)))

# ==== cluster Cluster_2
V = ClusterInput()
pline = PolyLine(Vertices=V, Closed=False)
X = UnitX(Factor=Slider(6, range=0..10))
move = Move(Geometry=pline, Motion=expr("-x", X))  # -> Geometry, Transform
offset = OffsetCurve(Curve=move.Geometry, Distance=expr("-x", Slider(40, range=0..100)), Plane=PlaneXY(0, 0, 0), Corners=1)
crv = Curve([offset, move.Geometry])
explode = Explode(Curve=flatten(crv), Recursive=True)  # -> Segments, Vertices
item = ListItem(List=explode.Vertices, Index=0, Wrap=True)  # -> flatten(Item)
item_2 = ListItem(List=explode.Vertices, Index=-1, Wrap=True)  # -> flatten(Item)
number_slider = Slider(8.332, range=0..10)
pline_2 = PolyLine(Vertices=item, Closed=False)
pline_3 = PolyLine(Vertices=item_2, Closed=False)
Y = UnitY(Factor=number_slider)
Y_2 = UnitY(Factor=number_slider)
move_2 = Move(Geometry=pline_3, Motion=expr("-x", Y_2))  # -> Geometry, Transform
move_3 = Move(Geometry=pline_2, Motion=Y)  # -> Geometry, Transform
crv_2 = Curve(flatten([move_3.Geometry, move_2.Geometry, crv]))
bbox = BoundingBox(Content=crv_2, Plane=PlaneXY(0, 0, 0), UnionBox=True)  # -> Box, Box_2
preview = CustomPreview(Geometry=bbox.Box, Material=ColourSwatch(SwatchColor=RGB(0, 0, 0)))
