# Grasshopper definition 4. The Growth - 05162021.gh (Grasshopper 1.0.7)
# plug-ins: Human

# ---- group: If True, The target_n is disabled
toggle = BooleanToggle(False)

# ----
option = Slider(7, range=0..100)

# ---- group: animation
number_slider = Slider(360, range=36..360)
# connect the output R to the target_n if you want to make animation.
division = Division(A=number_slider, B="36")

# ----
rule = GhPythonScript(num_sels=Slider(10, range=0..100), option=option)  # -> out, rules, sel_rules_idxs; inputs num_sels: Int32
# ---------- rule: Python ----------
__author__ = "yanga"
__version__ = "2021.05.15"

import rhinoscriptsyntax as rs
import random

# The rule here indicates the next port you want to connect to!
# If you have maximum 4 rules, the bigget number you can enter then is 3

random.seed(option)

rules = [
'top',
'left',
'right',
'bottom'
]

sel_rules_idxs = []
for n in range(num_sels):
    print 1
    sel_rules_idxs.append(random.choice(range(0,4)))
# ---------- end rule ----------
brick = GhPythonScript()  # -> out, brick, brick_data
# ---------- brick: Python ----------
__author__ = "yanga"
__version__ = "2021.05.08"

import rhinoscriptsyntax as rs
import Rhino.Geometry as rg


# This class is where all your fundamental bricks are originated from.

class Brick(object):
    
    def __init__(self, depth, width, color, id):
        self.depth = depth
        self.width = width
        self.color = color
        self.id = id
        self.origin = self.create_origin()
        self.ports = self.create_port_dict()
        self.footprint = self.display()
    
    def __repr__(self):
        return "Brick_" + str(self.id)
    
    def create_origin(self):
        return rg.Plane.WorldXY
    
    def create_port_dict(self):
        ports = {}
        port_id = ["top", "left", "right", "bottom"]
        for id in port_id:
            ports[id]= {
            "plane": self.get_port_plane(id),
            "neighbor": None
            }
        return ports
    
    def get_port_plane(self, port_id):
        if port_id == "top":
            og_plane = self.origin.Clone()
            offset_y = og_plane.YAxis * (self.depth)
            offset_x = og_plane.XAxis * (self.width / 2)
            og_plane.Translate(offset_y + offset_x)
        elif port_id == "left":
            og_plane = self.origin.Clone()
            offset_y = og_plane.YAxis * (self.depth / 2)
            og_plane.Translate(offset_y)
        elif port_id == "right":
            og_plane = self.origin.Clone()
            offset_y = og_plane.YAxis * (self.depth / 2)
            offset_x = og_plane.XAxis * (self.width)
            og_plane.Translate(offset_y + offset_x)
        elif port_id == "bottom":
            og_plane = self.origin.Clone()
            offset = og_plane.XAxis * (self.width / 2)
            og_plane.Translate(offset)
        
        return og_plane
    
    def update_ports(self,this_port, other_port, other_brick):
        self.ports[this_port]["neighbor"] = other_brick
        other_brick.ports[other_port]["neighbor"] = self
    
    
    def move(self, t):
        self.origin.Transform(t)
        self.footprint.Transform(t)
        for port in self.ports:
            self.ports[port]["plane"].Transform(t)
    
    def display(self):
        # this function get the footprint 2d display
        pt1 = self.origin.Origin
        pt2 = rg.Point3d(self.width, self.origin.Origin.Y, 0)
        pt3 = rg.Point3d(self.width, self.depth, 0)
        pt4 = rg.Point3d(self.origin.Origin.X, self.depth, 0)
        footprint = rg.Polyline([pt1, pt2, pt3, pt4, pt1])
        return footprint


brick = Brick

# brick parametric data
brick_red = {"depth":6, "width":8, "color":"red"}
brick_green = {"depth":15, "width":8, "color":"green"}
brick_blue = {"depth":6, "width":14, "color":"blue"}
brick_data = [brick_red, brick_green, brick_blue]
# ---------- end brick ----------
xy = XYPlane(Origin=Point(0, 0, 0))
stack_bricks = GhPythonScript(
    brick=brick.brick,
    brick_data=brick.brick_data,
    start_plane=xy,
    rules=rule.rules,
    target_n=Slider(11, range=1..11),
    option=option,
    rule_seq=rule.sel_rules_idxs,
    use_rule_seq=toggle)  # -> out, footprints, used_ports, used_bricks, connected_ports_name, grow_rule_seq; inputs brick_data: list, start_plane: Plane, rules: list, target_n: Int32, rule_seq: list of Int32, use_rule_seq: Boolean
# ---------- stack_bricks: Python ----------
__author__ = "yanga"
__version__ = "2021.05.15"

import rhinoscriptsyntax as rs
import Rhino.Geometry as rg
import ghpythonlib as gp
import random
import math

random.seed(option)

class Stack_bricks(object):
    def __init__(self, brick_data, rules, target_n, start_plane):
        self.brick_data = brick_data
        self.rules = rules
        self.target_n = target_n
        self.start_plane = start_plane
        self.bricks = []
        self.connected_ports = []
        self.connected_bricks = []
        self.connected_ports_name = []
        self.grow_rule_seq = []
    
    def orient_brick(self, cur_port, target_port):
        # I don't have time to clean this, but I think there must be a simpler implementation
        # of this logic. The general idea here is to orient the block based on which port it connects to.
        if cur_port == target_port:
            rotation = math.pi
        elif cur_port == "top" and target_port != "bottom":
            if target_port == "right":
                rotation = math.pi/2
            elif target_port == "left":
                rotation = math.pi/2 * -1
        elif cur_port == "bottom" and target_port != "top":
            if target_port == "right":
                rotation = math.pi/2 * -1
            elif target_port == "left":
                rotation = math.pi/2
        elif cur_port == "right" and target_port != "left":
            if target_port == "top":
                rotation = math.pi/2 * -1
            elif target_port == "bottom":
                rotation = math.pi/2
        elif cur_port == "left" and target_port != "right":
            if target_port == "top":
                rotation = math.pi/2
            elif target_port == "bottom":
                rotation = math.pi/2 * -1
        else:
            rotation = 0
       
        return rotation

    def stack_brick(self, cur_brick_data, target_brick, cur_port, target_port, id):
        # super messy here. The idea is to connect the brick after it's oriented correctly.
        cur_brick = brick(cur_brick_data["depth"], cur_brick_data["width"], cur_brick_data["color"], id)
        rotation = self.orient_brick(cur_port, target_port)
        target_brick.ports[target_port]["plane"].Rotate(rotation, rg.Vector3d.ZAxis)
        target_port_plane = target_brick.ports[target_port]["plane"]
        cur_port_plane = cur_brick.ports[cur_port]["plane"]
        t = rg.Transform.PlaneToPlane(cur_port_plane, target_port_plane)
        self.connected_ports.append(cur_port_plane)
        self.connected_bricks.append(target_brick.footprint)
        self.connected_ports_name.append(str(target_brick) + " " + target_port)
        cur_brick.move(t)
        cur_brick.update_ports(cur_port, target_port, target_brick)
        return cur_brick
    
    def add_brick(self, new_brick):
        self.bricks.append(new_brick)
    
    def all_open_ports(self):
        open_ports = []
        for brick in self.bricks:
            for port in brick.ports:
                if brick.ports[port]["neighbor"] == None:
                    open_ports.append([brick, port])
        target_brick, target_port = random.choice(open_ports)
        return target_brick, target_port
    
    def generate(self):
        # the main loop that generates the brick mass. Two rules here, you either give it a pre-made detemrinistic rule ids.
        # or adjust the target_n to randomly generate one.
        start_brick_data = random.choice(self.brick_data,)
        start_brick = brick(start_brick_data["depth"], start_brick_data["width"], start_brick_data["color"], 0)
        self.add_brick(start_brick)
        cur_n = 0
        if use_rule_seq:
            target_num = len(rule_seq)
        else:
            target_num = target_n

        while cur_n < target_num:
            target_brick, target_port = self.all_open_ports()
            cur_brick_data = random.choice(self.brick_data)
            if use_rule_seq:
                sel_rule_idx = int(rule_seq[cur_n])
                cur_port = self.rules[sel_rule_idx]
            else:
                cur_port = random.choice(self.rules)
                self.grow_rule_seq.append(cur_port)
            new_brick_id = cur_n + 1
            cur_brick = self.stack_brick(cur_brick_data, target_brick, cur_port, target_port,  new_brick_id)
            self.add_brick(cur_brick)
            cur_n += 1




brick = brick
stack_bricks = Stack_bricks(brick_data, rules, target_n, start_plane)
stack_bricks.generate()

# All the stuff below are for visualization
planes = [brick.origin for brick in stack_bricks.bricks]
footprints = [brick.footprint for brick in stack_bricks.bricks]
used_ports = stack_bricks.connected_ports
used_bricks = stack_bricks.connected_bricks
connected_ports_name = stack_bricks.connected_ports_name
grow_rule_seq = stack_bricks.grow_rule_seq
# ---------- end stack_bricks ----------
xy_2 = XYPlane(Origin=Point(0, 0, 0))

# ---- group: VISUALIZATION
area = Area(Geometry=stack_bricks.used_bricks)  # -> Area, Centroid
number_slider_2 = Slider(5, range=0..100)
vec2pt = Vector2Pt(PointA=area.Centroid, PointB=stack_bricks.used_ports, Unitize=False)  # -> Vector, Length
line = LineSDL(Start=stack_bricks.used_ports, Direction=vec2pt.Vector, Length=number_slider_2)
explode = Explode(Curve=line, Recursive=True)  # -> Segments, Vertices
item = ListItem(List=explode.Vertices, Index=0, Wrap=True)  # -> flatten(Item), flatten(Item1)
make_arrow = GhPythonScript(pts=item.Item, dist=number_slider_2, vec=vec2pt.Vector, pointers=item.Item1)  # -> out, all_pts; inputs pts: list of Point3d, vec: list of Point3d, pointers: list of Point3d
# ---------- make_arrow: Python ----------
__author__ = "yanga"
__version__ = "2021.05.15"

import rhinoscriptsyntax as rs
import Rhino.Geometry as rg
import ghpythonlib.treehelpers as th
import copy

factor = 0.75

all_pts = []
for idx in range(len(pts)):
    pt1 = copy.copy(pts[idx])
    pt2 = copy.copy(pts[idx])
    if abs(vec[idx].X) < 0.0001:
        if vec[idx].Y < 0:
            dir = -1
        else:
            dir = 1
        pt1.X += factor/2
        pt2.X -= factor/2
        pt1.Y += (dist-factor) * dir
        pt2.Y += (dist-factor)  * dir
    elif abs(vec[idx].Y) < 0.0001:
        if vec[idx].X < 0:
            dir = -1
        else:
            dir = 1
        pt1.Y += factor/2
        pt2.Y -= factor/2
        pt1.X += (dist-factor)  * dir
        pt2.X += (dist-factor)  * dir
    all_pts.append([pt1, pt2, pointers[idx]])

all_pts = th.list_to_tree(all_pts)
# ---------- end make_arrow ----------
pt = Point(item.Item)
crv = Curve(stack_bricks.footprints)
pline = PolyLine(Vertices=make_arrow.all_pts, Closed=True)
python = GhPythonScript(x=rule.sel_rules_idxs)  # -> out, a, b, c; inputs x: list
# ---------- python: Python ----------
__author__ = "yanga"
__version__ = "2021.05.15"

import rhinoscriptsyntax as rs


a = "The rule ID sequence is: " + str([i for i in x])
b = "In a way, one set of rule ID represente a completely new design."
c = "Can we use all simple sequence matrix to train the machine to generate desired designs?"
# ---------- end python ----------
python_2 = GhPythonScript(x=stack_bricks.grow_rule_seq, z=rule.sel_rules_idxs, y=rule.rules)  # -> out, a, b, c, d, e, f; inputs x: list, z: list, y: list
# ---------- python_2: Python ----------
__author__ = "yanga"
__version__ = "2021.05.15"

import rhinoscriptsyntax as rs

print y

e = "The rule collections: 1. connect to top 2. connecto to left 3. connect to right, 4. connecto bottom."
f = "The numeric representations of the rules: 1 - 2 - 3 - 4"
if x:
    a = "The deterministic rule ID sequence is: " + str([y.index(i) for i in x])
elif z:
    a = "The generated rule ID sequence is: " + str([i for i in z])
#b = "In a way, one set of rule ID represente a completely new design."
#c = "Can we use all simple sequence matrix to train the machine to generate desired designs?"
# ---------- end python_2 ----------
Y = UnitY(Factor=Slider(0.647, range=0..10))
move = Move(Geometry=item.Item, Motion=expr("-x", Y))  # -> Geometry, Transform
boundary = BoundarySurfaces(Edges=pline)
pt_2 = Point([<point referenced from the Rhino model> x3])
pt_3 = Point([<point referenced from the Rhino model> x3])
tag = TextTag3D(Location=pt_2, Text=[python.a, python.b, python.c], Size=Slider(2, range=0..10), Justification=7)
tag_2 = TextTag3D(Location=move.Geometry, Text=stack_bricks.connected_ports_name, Size=Slider(0.5, range=0..1), Justification=2)
tag_3 = TextTag3D(
    Location=pt_3,
    Text=[python_2.e, python_2.f, python_2.a],
    Size=[Slider(3, range=0..10), Slider(3, range=0..10), Slider(3, range=0..10)],
    Justification=7)

# ----
rotate = Rotate(Geometry=crv, Angle=degrees(number_slider), Plane=xy_2)  # -> Geometry, Transform

# ---- group: VISUALIZATION (continued)
lng = ListLength(List=rotate.Geometry)
cluster = Cluster(G=rotate.Geometry, N=lng, crv=rotate.Geometry)  # -> flatten(B)
runion = RegionUnion(Curves=rotate.Geometry)
mesh = Mesh(cluster)
cluster_2 = Cluster_2(C=rotate.Geometry, G=runion, A=runion)  # -> L, M, S, crv_3
preview = CustomPreview(Geometry=mesh, Material=ColourSwatch(SwatchColor=RGBA(215, 176, 255, 79)))
previewlw = CustomPreviewLineweights(Geometry=runion, Shader=ColourSwatch(SwatchColor=RGB(0, 0, 0)), Thickness=Slider(0, range=0..10), Absolute=False)
previewlw_2 = CustomPreviewLineweights(
    Geometry=rotate.Geometry,
    Shader=ColourSwatch(SwatchColor=RGB(0, 0, 0)),
    Thickness=Slider(2, range=0..10),
    Absolute=False)
mcol = MeshColours(Mesh=cluster_2.M, Colours=ColourSwatch(SwatchColor=RGB(255, 204, 204)))
preview_2 = CustomPreview(Geometry=cluster_2.S, Material=ColourSwatch(SwatchColor=RGB(235, 235, 235)))
crv_2 = Curve(cluster_2.L)

# ==== cluster Cluster
N = ClusterInput()
random = Random(Range=Domain(5, 10), Number=N, Seed=2)
G = ClusterInput()
crv = ClusterInput()
Z = UnitZ(Factor=random)
crv_2 = Curve(simplify(graft(crv)))
move = Move(Geometry=G, Motion=Z)  # -> simplify(graft(Geometry)), Transform
boundary = BoundarySurfaces(Edges=move.Geometry)
loft = Loft(
    Curves=[move.Geometry, crv_2],
    Options={Adjust=False, Closed=False, LoftEnds=0, LoftSimp=0, LoftType=0, Rebuild=10, Refit=0.01})
join = BrepJoin(Breps=[boundary, loft])  # -> Breps, Closed
B = ClusterOutput(join.Breps)

# ==== cluster Cluster_2
C = ClusterInput()
bbox = BoundingBox(Content=C, Plane=PlaneXY(0, 0, 0), UnionBox=True)  # -> Box, Box_2
debrep = DeconstructBrep(Brep=bbox.Box)  # -> Faces, Edges, Vertices
crv = Curve(debrep.Edges)
join = JoinCurves(Curves=crv, Preserve=False)
offset = OffsetCurve(Curve=join, Distance=Slider(10, range=0..100), Plane=PlaneXY(0, 0, 0), Corners=1)
G = ClusterInput()
A = ClusterInput()
area = Area(Geometry=G)  # -> Area, Centroid
sort = SortList(Keys=area.Area, ValuesA=A)  # -> Keys, ValuesA
item = ListItem(List=sort.ValuesA, Index=-1, Wrap=True)
random = Random(Range=Domain(0, 100), Number=Slider(10, range=0..100), Seed=Slider(5, range=0..10))
pop2d = Populate2D(Region=offset, Count=100, Seed=1)
int = Integer(random)
incurve = PointInCurve(Point=flatten(pop2d), Curve=item)  # -> Relationship, Point
equals = Equality(FirstNumber=incurve.Relationship, SecondNumber=0)  # -> Equality, Inequality
dispatch = Dispatch(List=pop2d, DispatchPattern=equals.Equality)  # -> ListA, ListB
boundary = BoundarySurfaces(Edges=offset)
item_2 = ListItem(List=dispatch.ListA, Index=int, Wrap=True)
duppt = RemoveDuplicatePts(Points=item_2, Tolerance=0.01)
lng = ListLength(List=duppt)
random_2 = Random(Range=Domain(2, 6), Number=lng, Seed=2)
line = LineSDL(Start=duppt, Direction=Vector(0, 0, 1), Length=random_2)
explode = Explode(Curve=line, Recursive=True)  # -> Segments, Vertices
random_3 = Random(Range=Domain(0.5, 2.5), Number=lng, Seed=2)
item_3 = ListItem(List=explode.Vertices, Index=1, Wrap=True)  # -> flatten(Item)
msphere = MeshSphere(Base=item_3, Radius=random_3, UCount=10, VCount=20)
crv_2 = Curve(sort.ValuesA)
S = ClusterOutput(boundary)
L = ClusterOutput(line)
M = ClusterOutput(msphere)
crv_3 = ClusterOutput(crv_2)
