# Grasshopper definition 5. The knowledge - 06062021.gh (Grasshopper 1.0.7)
# plug-ins: Pufferfish, Human, Kangaroo2 Components

# ---- group: If True, The target_n is disabled
toggle = BooleanToggle(False)

# ----
num_samples = Slider(1, range=0..10000)
option = Slider(0, range=0..100)
deterministic_rules = Panel("""3
1
1
2
2
1
1
1
2
1
1
1
3
3
2
3
3""")
rule = GhPythonScript(option=option)  # -> out, rules
# ---------- rule: Python ----------
__author__ = "yanga"
__version__ = "2021.05.15"

import rhinoscriptsyntax as rs
import random

# The rule here indicates the next port you want to connect to!
# If you have maximum 4 rules, the bigget number you can enter then is 3

random.seed(option)

rules = [
'top',
'left',
'right',
'bottom'
]
# ---------- end rule ----------
brick = GhPythonScript()  # -> out, brick, brick_data
# ---------- brick: Python ----------
__author__ = "yanga"
__version__ = "2021.05.08"

import rhinoscriptsyntax as rs
import Rhino.Geometry as rg
import math


# This class is where all your fundamental bricks are originated from.

class Brick(object):
    
    def __init__(self, depth, width, color, rules, id):
        self.depth = depth
        self.width = width
        self.color = color
        self.rules = rules
        self.id = id
        self.origin = self.create_origin()
        self.ports = self.create_port_dict()
        self.footprint = self.display()
    
    def __repr__(self):
        return "Brick_" + str(self.id)
    
    def create_origin(self):
        return rg.Plane.WorldXY
    
    def create_port_dict(self):
        ports = {}
        port_id = ["left", "right", "bottom"]
        for id in port_id:
            ports[id]= {
            "plane": self.get_port_plane(id),
            "neighbor": None
            }
        return ports
    
    def get_port_plane(self, port_id):
        if port_id == "top":
            og_plane = self.origin.Clone()
            offset_y = og_plane.YAxis * (self.depth)
            offset_x = og_plane.XAxis * (self.width / 2)
            og_plane.Translate(offset_y + offset_x)
        elif port_id == "left":
            og_plane = self.origin.Clone()
            offset_y = og_plane.YAxis * (self.depth / 2)
            og_plane.Translate(offset_y)
            og_plane.Rotate(math.pi/2, rg.Vector3d.ZAxis)
        elif port_id == "right":
            og_plane = self.origin.Clone()
            offset_y = og_plane.YAxis * (self.depth / 2)
            offset_x = og_plane.XAxis * (self.width)
            og_plane.Translate(offset_y + offset_x)
            og_plane.Rotate(math.pi/2*-1, rg.Vector3d.ZAxis)
        elif port_id == "bottom":
            og_plane = self.origin.Clone()
            offset = og_plane.XAxis * (self.width / 2)
            og_plane.Translate(offset)
            og_plane.Rotate(math.pi, rg.Vector3d.ZAxis)
        
        return og_plane
    
    def update_ports(self,this_port, other_port, other_brick):
        self.ports[this_port]["neighbor"] = other_brick
        other_brick.ports[other_port]["neighbor"] = self
    
    
    def move(self, t):
        self.origin.Transform(t)
        self.footprint.Transform(t)
        for port in self.ports:
            self.ports[port]["plane"].Transform(t)
    
    def display(self):
        # this function get the footprint 2d display
        pt1 = self.origin.Origin
        pt2 = rg.Point3d(self.width, self.origin.Origin.Y, 0)
        pt3 = rg.Point3d(self.width, self.depth, 0)
        pt4 = rg.Point3d(self.origin.Origin.X, self.depth, 0)
        footprint = rg.Polyline([pt1, pt2, pt3, pt4, pt1])
        return footprint


brick = Brick

# brick parametric data
brick_red = {"depth":6, "width":8, "color":"red", "rules":["bottom", "left", "right"]}
brick_green = {"depth":15, "width":8, "color":"green", "rules":["bottom", "left", "right"]}
brick_blue = {"depth":30, "width":16, "color":"blue", "rules":["bottom", "left", "right"]}
brick_data = [brick_blue]
# ---------- end brick ----------
xy = XYPlane(Origin=Point(0, 0, 0))
stack_bricks = GhPythonScript(
    brick=brick.brick,
    brick_data=brick.brick_data,
    start_plane=xy,
    rules=rule.rules,
    target_n=Slider(10, range=1..100),
    option=option,
    rule_seq=deterministic_rules,
    use_rule_seq=toggle,
    num_training_samples=num_samples)  # -> out, connected_bricks_fp, used_ports, used_bricks_fp, connected_ports_name, grow_rule_seq; inputs brick_data: list, start_plane: Plane, rules: list, target_n: Int32, rule_seq: list of Int32, use_rule_seq: Boolean, num_training_samples: Int32
# ---------- stack_bricks: Python ----------
__author__ = "yanga"
__version__ = "2021.05.15"

import rhinoscriptsyntax as rs
import Rhino.Geometry as rg
import ghpythonlib as gp
import random
import math
import copy
import json
import os
print os.getcwd()
random.seed(option)

class Stack_bricks(object):
    def __init__(self, brick_data, rules, target_n, start_plane):
        self.brick_data = brick_data
        self.rules = rules
        self.target_n = target_n
        self.start_plane = start_plane
        self.bricks = []
        self.connected_ports = []
        self.targe_ports_names = []
        self.connected_bricks_fp = []
        self.connected_ports_name = []
        self.grow_rule_seq = []
        self.connected_bricks_id = []
    
    def shrink(self, cur_brick_fp, cur_brick_og):
        cnt = copy.copy(cur_brick_og.Origin)
        fp = copy.copy(rg.PolylineCurve(cur_brick_fp))
        t = rg.Transform.Scale(cnt, 0.9)
        fp.Transform(t)
        return fp
    
    def collision(self, cur_brick):
        #temp_brick = copy.copy(cur_brick)
        all_collisions = 0
        for brick in self.bricks:
            test_cur_brick_fp = self.shrink(cur_brick.footprint, cur_brick.origin)
            n_collisions = rg.Intersect.Intersection.CurveCurve(test_cur_brick_fp, rg.PolylineCurve(brick.footprint), 0.001, 0.0)
            all_collisions += len(n_collisions)
        if all_collisions >= 2:
            return True
        else:
            return False
        
    def stack_brick(self, cur_brick_data, target_brick, cur_port, target_port, id):
        # orient new bricks to the target position
        cur_brick = brick(cur_brick_data["depth"], cur_brick_data["width"], cur_brick_data["color"], cur_brick_data["rules"], id)
        target_plane = target_brick.ports[target_port]["plane"]
        rotation = math.pi
        target_port_plane = target_brick.ports[target_port]["plane"]
        cur_port_plane = cur_brick.ports[cur_port]["plane"]
        cur_port_plane.Rotate(rotation, rg.Vector3d.ZAxis)
        t = rg.Transform.PlaneToPlane(cur_port_plane, target_port_plane)
        
        # move new bricks to place
        cur_brick.move(t)
        is_collide = self.collision(cur_brick)
        # if collide with existing bricks, return False, meaning not to grow this brick, and shut down the current target brick port
        if not is_collide:
            # for visualizations
            self.connected_ports.append(cur_port_plane)
            self.connected_bricks_fp.append(target_brick.footprint)
            self.connected_ports_name.append(str(target_brick) + " " + target_port)
            self.connected_bricks_id.append(target_brick.id)
            self.targe_ports_names.append(rules.index(target_port))
            cur_brick.update_ports(cur_port, target_port, target_brick)
            return cur_brick, is_collide
        else:
            target_brick.ports[cur_port]["neighbor"] = "closed"
            return cur_brick, is_collide
    
    def add_brick(self, new_brick):
        self.bricks.append(new_brick)
    
    def all_open_ports(self):
        target_port = None
        target_brick = None
        open_ports = []
        for brick in self.bricks:
            for port in brick.ports:
                if brick.ports[port]["neighbor"] == None:
                    open_ports.append([brick, port])
        if open_ports:
            target_brick, target_port = random.choice(open_ports)
        return target_brick, target_port
    
    
    def generate(self):
        # the main loop that generates the brick mass. Two rules here, you either give it a pre-made detemrinistic rule ids.
        # or adjust the target_n to randomly generate one.
        start_brick_data = random.choice(self.brick_data,)
        start_brick = brick(start_brick_data["depth"], start_brick_data["width"], start_brick_data["color"], start_brick_data["rules"], 0)
        self.add_brick(start_brick)
        target_brick, target_port = self.all_open_ports()
        cur_n = 0
        safe_max = 100
        if use_rule_seq:
            target_num = len(rule_seq)
        else:
            target_num = target_n
        while cur_n < target_num and target_port and cur_n < safe_max:
            cur_brick_data = random.choice(self.brick_data)
            if use_rule_seq:
                sel_rule_idx = int(rule_seq[cur_n])
                cur_port = self.rules[sel_rule_idx]
            else:
                cur_port = random.choice(cur_brick_data["rules"])
            new_brick_id = cur_n + 1
            cur_brick, is_collide = self.stack_brick(cur_brick_data, target_brick, cur_port, target_port,  new_brick_id)
            if not is_collide:
                self.grow_rule_seq.append(cur_port)
                self.add_brick(cur_brick)
                cur_n += 1
            target_brick, target_port = self.all_open_ports()




brick = brick
rules_training_sets = {
}

# export discreet rules in JSON from here
for n in range (num_training_samples):
    path = "C:\\Users\\yanga\\Dropbox\\Work\\Generative design in grasshopper\\Growth\\rules_training_samples\\"
    stack_bricks = Stack_bricks(brick_data, rules, target_n, start_plane)
    stack_bricks.generate()

    # These are the important data and visualization generated from each design option
    used_ports = stack_bricks.connected_ports
    connected_bricks_fp = stack_bricks.connected_bricks_fp
    connected_ports_name = stack_bricks.connected_ports_name
    connected_bricks_id = stack_bricks.connected_bricks_id
    targe_ports_names = stack_bricks.targe_ports_names
    grow_rule_seq = stack_bricks.grow_rule_seq
    cur_ports_names = [rules.index(rule) for rule in grow_rule_seq]
    # store data in one dictionary for each design option
    training_set = {
    "brick_ids": connected_bricks_id,
    "cur_ports_ids": cur_ports_names,
    "target_ports_ids": targe_ports_names
    }
    # store each design option in a global dictionary, so this can be used outside this python component
    rules_training_sets[n] = training_set
    file_name = "rules_" + str(n) +".json"
    file_path = os.path.join(path, file_name)

    with open(file_path, "w") as json_file:
        json.dump(training_set, json_file)
# ---------- end stack_bricks ----------
xy_2 = XYPlane(Origin=Point(0, 0, 0))

# ---- group: VISUALIZATION, you will need Human UI plugin
area = Area(Geometry=stack_bricks.used_bricks_fp)  # -> Area, Centroid
vec2pt = Vector2Pt(PointA=area.Centroid, PointB=stack_bricks.used_ports, Unitize=False)  # -> Vector, Length
line = LineSDL(Start=stack_bricks.used_ports, Direction=vec2pt.Vector, Length=Slider(5, range=0..100))
explode = Explode(Curve=line, Recursive=True)  # -> Segments, Vertices
item = ListItem(List=explode.Vertices, Index=0, Wrap=True)  # -> flatten(Item), flatten(Item1)
pt = Point(item.Item)
crv = Curve(stack_bricks.connected_bricks_fp)
Y = UnitY(Factor=Slider(0.647, range=0..10))
move = Move(Geometry=item.Item, Motion=expr("-x", Y))  # -> Geometry, Transform
tag = TextTag3D(Location=move.Geometry, Text=stack_bricks.connected_ports_name, Size=Slider(0.5, range=0..1), Justification=2)

# ----
rotate = Rotate(Geometry=crv, Angle=degrees(1.570796327), Plane=xy_2)  # -> Geometry, Transform

# ---- group: VISUALIZATION, you will need Human UI plugin (continued)
lng = ListLength(List=rotate.Geometry)
cluster = Cluster(G=rotate.Geometry, N=lng, crv=rotate.Geometry)  # -> flatten(B)
runion = RegionUnion(Curves=rotate.Geometry)
mesh = Mesh(cluster)
cluster_2 = Cluster_2(C=rotate.Geometry, G=runion, A=runion)  # -> L, M, S, crv_3
preview = CustomPreview(Geometry=mesh, Material=ColourSwatch(SwatchColor=RGBA(215, 176, 255, 70)))
previewlw = CustomPreviewLineweights(Geometry=runion, Shader=ColourSwatch(SwatchColor=RGB(0, 0, 0)), Thickness=Slider(0, range=0..10), Absolute=False)
previewlw_2 = CustomPreviewLineweights(
    Geometry=rotate.Geometry,
    Shader=ColourSwatch(SwatchColor=RGB(0, 0, 0)),
    Thickness=Slider(2, range=0..10),
    Absolute=False)
mcol = MeshColours(Mesh=cluster_2.M, Colours=ColourSwatch(SwatchColor=RGB(255, 204, 204)))
preview_2 = CustomPreview(Geometry=cluster_2.S, Material=ColourSwatch(SwatchColor=RGB(235, 235, 235)))
crv_2 = Curve(cluster_2.L)

# ---- group: Get point clouds, you will need Kangaroo
crv_3 = Curve(runion)
boundary = BoundarySurfaces(Edges=crv_3)
Z = UnitZ(Factor=Slider(12, range=0..100))
offmsh = OffsetMesh(Mesh=boundary, Distance=Z, BothSides=False, CreateSolid=True)
refine = Refine(Mesh=offmsh, Level=Slider(3, range=0..10))
demesh = DeconstructMesh(Mesh=refine)  # -> Vertices, Faces, Colours, Normals

# ==== cluster Cluster
N = ClusterInput()
random = Random(Range=Domain(5, 10), Number=N, Seed=2)
G = ClusterInput()
crv = ClusterInput()
Z = UnitZ(Factor=Slider(12, range=0..100))
crv_2 = Curve(simplify(graft(crv)))
move = Move(Geometry=G, Motion=Z)  # -> simplify(graft(Geometry)), Transform
boundary = BoundarySurfaces(Edges=move.Geometry)
loft = Loft(
    Curves=[move.Geometry, crv_2],
    Options={Adjust=False, Closed=False, LoftEnds=0, LoftSimp=0, LoftType=0, Rebuild=10, Refit=0.01})
join = BrepJoin(Breps=[boundary, loft])  # -> Breps, Closed
B = ClusterOutput(join.Breps)

# ==== cluster Cluster_2
C = ClusterInput()
bbox = BoundingBox(Content=C, Plane=PlaneXY(0, 0, 0), UnionBox=True)  # -> Box, Box_2
debrep = DeconstructBrep(Brep=bbox.Box)  # -> Faces, Edges, Vertices
crv = Curve(debrep.Edges)
join = JoinCurves(Curves=crv, Preserve=False)
offset = OffsetCurve(Curve=join, Distance=Slider(10, range=0..100), Plane=PlaneXY(0, 0, 0), Corners=1)
G = ClusterInput()
A = ClusterInput()
area = Area(Geometry=G)  # -> Area, Centroid
sort = SortList(Keys=area.Area, ValuesA=A)  # -> Keys, ValuesA
item = ListItem(List=sort.ValuesA, Index=-1, Wrap=True)
random = Random(Range=Domain(0, 100), Number=Slider(10, range=0..100), Seed=Slider(5, range=0..10))
pop2d = Populate2D(Region=offset, Count=100, Seed=1)
int = Integer(random)
incurve = PointInCurve(Point=flatten(pop2d), Curve=item)  # -> Relationship, Point
equals = Equality(FirstNumber=incurve.Relationship, SecondNumber=0)  # -> Equality, Inequality
dispatch = Dispatch(List=pop2d, DispatchPattern=equals.Equality)  # -> ListA, ListB
boundary = BoundarySurfaces(Edges=offset)
item_2 = ListItem(List=dispatch.ListA, Index=int, Wrap=True)
duppt = RemoveDuplicatePts(Points=item_2, Tolerance=0.01)
lng = ListLength(List=duppt)
random_2 = Random(Range=Domain(2, 6), Number=lng, Seed=2)
line = LineSDL(Start=duppt, Direction=Vector(0, 0, 1), Length=random_2)
explode = Explode(Curve=line, Recursive=True)  # -> Segments, Vertices
random_3 = Random(Range=Domain(0.5, 2.5), Number=lng, Seed=2)
item_3 = ListItem(List=explode.Vertices, Index=1, Wrap=True)  # -> flatten(Item)
msphere = MeshSphere(Base=item_3, Radius=random_3, UCount=10, VCount=20)
crv_2 = Curve(sort.ValuesA)
S = ClusterOutput(boundary)
L = ClusterOutput(line)
M = ClusterOutput(msphere)
crv_3 = ClusterOutput(crv_2)
