# Grasshopper definition intelligence.gh (Grasshopper 1.0.7)
# plug-ins: Human

number_slider = Slider(0, range=-1..1)
number_slider_2 = Slider(0, range=-1..1)
number_slider_3 = Slider(1, range=0..1)
number_slider_4 = Slider(0, range=-1..1)
number_slider_5 = Slider(0, range=-1..1)
z_vals = Merge(
    Data1=number_slider_3,
    Data2=Slider(0, range=-1..1),
    Data3=Slider(0, range=-1..1),
    Data4=Slider(0, range=-1..1),
    Data5=Slider(0, range=-1..1),
    Data6=number_slider_3,
    Data7=number_slider_3,
    Data8=Slider(0, range=-1..1),
    Data9=number_slider_3,
    Data10=number_slider_3)
linear_walk = RepeatData(Data=Slider(-0.907, range=-1..1), Length=10)
random_walk = Random(Range=Domain(-1, 1), Number="10", Seed=Slider(1000, range=0..1000))
# Switch this to test
# uniformed z values or
# adjusting various
# z values for each layer.
panel = Panel("1")
filter = StreamFilter(Gate=panel, Stream0=linear_walk, Stream1=z_vals, Stream2=random_walk)
z_vals_input = Panel(filter)
decoder = GhPythonScript(url="http://127.0.0.1:5000/test", z_vals=filter)  # -> out, simplify(result); inputs z_vals: list
# ---------- decoder: Python ----------
__author__ = "yanga"
__version__ = "2021.06.26"

import rhinoscriptsyntax as rs
import ghpythonlib.treehelpers as th
import json
import urllib2

input_data = {
    "data": z_vals
}

req = urllib2.Request(url)
req.add_data(json.dumps(input_data))
req.add_header('Content-Type', 'application/json')
req.add_header('Accept', 'application/json')
resp = urllib2.urlopen(req)
resp = json.loads(resp.read().decode('utf-8'))
resp = resp["data"]

result = th.list_to_tree(resp)
# ---------- end decoder ----------
number_slider_6 = Slider(100, range=0..100)
item = ListItem(List=decoder.result, Index=0, Wrap=True)  # -> Item, Item1, Item2
rgb = ColourRGB(Alpha=255, Red=item.Item, Green=item.Item1, Blue=item.Item2)  # -> flatten(Colour)
number_slider_7 = Slider(62.848, range=0..100)  # disabled
number_slider_8 = Slider(63.406, range=0..360)  # disabled
button = Button()  # disabled
mplane = MeshPlane(
    Boundary={Plane=PlaneXY(0, 0, 0), Size=Domain2(u=-10..10, v=-10..10)},
    WidthCount=expr("x-1", number_slider_6),
    HeightCount=expr("x-1", number_slider_6))  # -> Mesh, Area
set_up_frame = GhPythonScript(z_vals=filter, camera_rotation=number_slider_8, view_port_size_factor=number_slider_7, reset=button)  # -> out, result, vec, loc, screen_rect, pl; inputs z_vals: list; disabled
# ---------- set_up_frame: Python ----------
__author__ = "yanga"
__version__ = "2021.06.28"

import rhinoscriptsyntax as rs
import Rhino.Display as rd
import Rhino.Geometry as rg
import scriptcontext as sc
import math
from math import sqrt

factor = view_port_size_factor



width = sc.doc.Views.ActiveView.Bounds.Width
height = sc.doc.Views.ActiveView.Bounds.Height
target = sc.doc.Views.ActiveView.MainViewport.CameraTarget
location = sc.doc.Views.ActiveView.MainViewport.CameraLocation
target_vec = rg.Vector3d(rg.Point3d(target))
location_vec = rg.Vector3d(rg.Point3d(location))
vec = location_vec - target_vec
pl = rg.Plane(target,vec)
pl.Rotate(math.radians(camera_rotation), vec)
screen_rect = rg.Rectangle3d(pl, rg.Interval(-width/factor, width/factor), rg.Interval(-height/factor, height/factor))

loc = screen_rect.Corner(2)

z_vals = [float(z) for z in z_vals]

result = "The z values are: {}".format(z_vals)

print result
# ---------- end set_up_frame ----------
demesh = DeconstructMesh(Mesh=mplane.Mesh)  # -> Vertices, Faces, Colours, Normals
number_slider_9 = Slider(0, range=0..180)  # disabled
conmesh = ConstructMesh(Vertices=demesh.Vertices, Faces=demesh.Faces, Colours=rgb)
pln = Plane(set_up_frame.pl)  # disabled
pt = Point(set_up_frame.loc)  # disabled
crv = Curve(set_up_frame.screen_rect)  # disabled
rotate = Rotate(Geometry=pt, Angle=degrees(number_slider_9), Plane=set_up_frame.vec)  # -> Geometry, Transform; disabled
tag = TextTag(Location=pt, Text=set_up_frame.result)  # disabled
tag_2 = TextTag3D(Location=rotate.Geometry, Text=set_up_frame.result, Size=1, Justification=7)  # disabled

# ---- group: visualization
number_slider_10 = Slider(11, range=0..100)
number_slider_11 = Slider(19.19, range=0..100)
X = UnitX(Factor=expr("-x", number_slider_11))
Y = UnitY(Factor=number_slider_10)
visual = GhPythonScript(z_vals=z_vals_input)  # -> out, z_pts, pts, txt, title_pts; inputs z_vals: list
# ---------- visual: Python ----------
__author__ = "yanga"
__version__ = "2021.06.27"

import rhinoscriptsyntax as rs
import Rhino.Geometry as rg
import math
import random


pts = []
title_pts = []
txt = []
z_pts = []
n_z = len(z_vals)

for cur_y in range(5):
    cur_x = -1
    cur_z = -1
    steps = 0
    z_idx = cur_y*2
    title_pts.append(rg.Point3d(cur_x, cur_y*2, cur_z))
    txt.append("This is layer {}.".format(cur_y))
    
    cur_first_z = z_vals[z_idx-1]
    cur_second_z = z_vals[z_idx]
    z_pts.append(rg.Point3d(cur_first_z, cur_y*2, cur_second_z))
    
    while steps < 100:
        if steps % 10 == 0 and 0 < cur_x < 10:
            cur_z += 1
            cur_x = -1
        cur_pt = rg.Point3d(cur_x, cur_y*2, cur_z)
        pts.append(cur_pt)
        cur_x += 1
        steps += 1
# ---------- end visual ----------
addition = Addition(A=Y, B=X)
addition_2 = Addition(A=Slider(3.581, range=0..10), B=number_slider_11)
X_2 = UnitX(Factor=expr("-x", addition_2))
Y_2 = UnitY(Factor=number_slider_10)
addition_3 = Addition(A=Y_2, B=X_2)
move = Move(Geometry=visual.pts, Motion=addition)  # -> Geometry, Transform
pdecon = Deconstruct(Point=visual.pts)  # -> XComponent, YComponent, ZComponent
pt_2 = Point(visual.z_pts)
sort = SortList(Keys=pdecon.XComponent)  # -> Keys, ValuesA
move_2 = Move(Geometry=visual.title_pts, Motion=addition_3)  # -> Geometry, Transform
pdecon_2 = Deconstruct(Point=pt_2)  # -> XComponent, YComponent, ZComponent
item_2 = ListItem(List=sort.Keys, Index=-1, Wrap=True)
item_3 = ListItem(List=sort.Keys, Index=0, Wrap=True)
msphere = MeshSphere(Base=move.Geometry, Radius=Slider(0.05, range=0..1), UCount=10, VCount=20)
dom = ConstructDomain(DomainStart=-1, DomainEnd=1)
dom_2 = ConstructDomain(DomainStart=-1, DomainEnd=1)
dom_3 = ConstructDomain(DomainStart=item_3, DomainEnd=item_2)
partition = PartitionList(List=move.Geometry, Size=100)
remap = RemapNumbers(Value=pdecon_2.ZComponent, Source=dom, Target=dom_3)  # -> Mapped, Clipped
remap_2 = RemapNumbers(Value=pdecon_2.XComponent, Source=dom_2, Target=dom_3)  # -> Mapped, Clipped
number_slider_12 = Slider(2, range=0..10)
bbox = BoundingBox(Content=partition, Plane=PlaneXY(0, 0, 0), UnionBox=True)  # -> Box, Box_2
pt_3 = ConstructPoint(XCoordinate=remap_2.Mapped, YCoordinate=pdecon_2.YComponent, ZCoordinate=remap.Mapped)
neg = Negative(Value=number_slider_12)
debrep = DeconstructBrep(Brep=bbox.Box)  # -> Faces, Edges, Vertices
move_3 = Move(Geometry=pt_3, Motion=addition)  # -> Geometry, Transform
intcrv = Interpolate(Vertices=move_3.Geometry, Degree=3, Periodic=False, KnotStyle=1)  # -> Curve, Length, Domain
offset = OffsetCurve(Curve=intcrv.Curve, Distance=[number_slider_12, neg], Plane=PlaneXY(0, 0, 0), Corners=1)
item_4 = ListItem(List=debrep.Faces, Index=1, Wrap=True)
loft = Loft(Curves=flatten(offset), Options={Adjust=False, Closed=False, LoftEnds=0, LoftSimp=0, LoftType=0, Rebuild=10, Refit=0.01})
pline = PolyLine(Vertices=move_3.Geometry, Closed=False)
material = CreateMaterial(Diffuse=RGB(255, 255, 255), Specular=RGB(255, 255, 255), Emission=RGB(0, 0, 0), Transparency=0.5, Shine=1)
mesh = MeshBrep(
    Brep=item_4,
    Settings={GridMaxCount=0, GridMinCount=16, JaggedSeams=False, MaxEdgeLength=0, MinEdgeLength=0.0001, MinTolerance=0, Refine=True, RefineAngle=0, RelativeTolerance=0.65, SimplePlanes=True, Tolerance=0})
crv_2 = Curve(debrep.Edges)
preview = CustomPreview(Geometry=mesh, Material=material)
preview_2 = CustomPreview(Geometry=loft, Material=ColourSwatch(SwatchColor=RGB(252, 134, 66)))
preview_3 = CustomPreview(Geometry=msphere, Material=ColourSwatch(SwatchColor=RGB(102, 102, 102)))
previewlw = CustomPreviewLineweights(Geometry=crv_2, Shader=ColourSwatch(SwatchColor=RGB(194, 194, 194)), Thickness=Slider(0, range=0..10), Absolute=False)
tag_3 = TextTag3D(
    Location=move_2.Geometry,
    Text=visual.txt,
    Size=Slider(0.4, range=0..1),
    Colour=ColourSwatch(SwatchColor=RGB(0, 0, 0)),
    Justification=5)
previewlw_2 = CustomPreviewLineweights(Geometry=pline, Shader=ColourSwatch(SwatchColor=RGB(0, 0, 0)), Thickness=Slider(3, range=0..10), Absolute=False)
