# Grasshopper definition The Uncertainty.gh (Grasshopper 1.0.7)
# plug-ins: Human

# ---- group: FOR VIDEO
number_slider = Slider(6, range=0..6)  # disabled
series = Series(Start=0, Step=1, Count=number_slider)  # disabled
panel = Panel("""livingroom
master_bedroom
guest_bedroom
kitchen
master_bath
guest_bath""")  # disabled
width = Panel("""30
20
20
15
15
10""")  # disabled
depth = Panel("""40
30
25
20
15
15""")  # disabled
item = ListItem(List=width, Index=series, Wrap=True)  # disabled
item_2 = ListItem(List=depth, Index=series, Wrap=True)  # disabled
item_3 = ListItem(List=panel, Index=series, Wrap=True)  # disabled
number_slider_2 = Slider(0, range=0..5)  # disabled
number_slider_3 = Slider(60, range=0..100)  # disabled
room = GhPythonScript()  # -> out, room; disabled
# ---------- room: Python ----------
__author__ = "yanga"
__version__ = "2021.07.30"

import rhinoscriptsyntax as rs
import Rhino.Geometry as rg
import System.Drawing as sd
import random
import math
import json


tol = 0.01

class Room:
    def __init__ (self, room_name, depth, width, location, id):
        self.room_name = room_name
        self.depth = depth
        self.width = width
        self.location = location
        self.id = id
        self.doors = []
        self.windows = []
        
    def __repr__ (self):
        return "%s #%s"%(self.room_name, self.width)
    
    def area(self):
        return self.depth * self.width
    
    def visual_3d(self):
        height = random.randint(10,16)
        crv = rg.Rectangle3d(self.location,rg.Interval(-self.width/2, self.width/2), rg.Interval(-self.depth/2, self.depth/2))
        crv = crv.ToNurbsCurve()
        result = rg.Extrusion.Create(crv, height, True)
        return result, crv
    
    
    def create_door(self, wall_edge):
        cnt = wall_edge.PointAt(0.5)
        self.doors.append(cnt)
    
    def create_window(self, wall_edge):
        cnt = wall_edge.PointAt(0.5)
        self.windows.append(cnt)
    
    def crv_dist(self, crv):
        pt1 = crv.PointAtEnd
        pt2 = crv.PointAtStart
        dist = math.sqrt((pt1.X - pt2.X)**2 + (pt1.Y - pt2.Y)**2)
        return dist
    
    def create_ray(self, plane):
        origin = plane.Origin
        axis = plane.XAxis
        ray1 = rg.Line(origin, axis, 2).ToNurbsCurve()
        ray2 = rg.Line(origin, -axis, 2).ToNurbsCurve()
        rays = rg.Curve.JoinCurves([ray1, ray2])
        return rays


room = Room
# ---------- end room ----------
pt = Point(<point referenced from the Rhino model>)  # disabled
pln = Plane(pt)  # disabled
floorplan = GhPythonScript(
    room=room.room,
    rooms=item_3,
    widths=item,
    depths=item_2,
    initial_room_idx=number_slider_2,
    origin=pln,
    seed=number_slider_3)  # -> out, reset, on, network, initial_rooms, rooms_3d, floor_name; inputs rooms: list, widths: list, depths: list, initial_room_idx: Int32, origin: Plane; disabled
# ---------- floorplan: Python ----------
__author__ = "yanga"
__version__ = "2021.07.31"

import rhinoscriptsyntax as rs
import Rhino.Geometry as rg
import ghpythonlib.componentbase
import random
import math
import time

random.seed(seed)

class Floorplan:
    def __init__ (self, room_names, widths, depths, initial_room_idx, id, origin):
        self.room_names = room_names
        self.widths = widths
        self.depths = depths
        self.initial_room_idx= initial_room_idx
        self.id = id
        self.origin = origin
        self.rooms = []
    
    def __repr__ (self):
        return "Floorplan #%s"%(self.id)
    
    def counterID(self):
        self.idCounter += 1
    
    def initialize(self):
        self.idCounter = 0
        self.initialize_rooms()
    
    def initialize_rooms(self):
        # create all other rooms to be pulled to the center room.
        initial_room_names = self.room_names
        initial_widths = self.widths
        initial_depths = self.depths
        self.network, initial_locations = self.distribution_network()
        for i in range(len(initial_room_names)):
            # update the room id
            self.counterID()
            cur_room = room(initial_room_names[i], initial_depths[i], initial_widths[i], initial_locations[i], self.idCounter)
            self.rooms.append(cur_room)
    
    def distribution_network(self):
        # create the 
        cnt = self.origin.Origin
        nums = len(self.room_names)
        lines = []
        locations = []
        r1 = 0
        rotation = random.uniform(1,nums) * math.pi / nums;
        for num in range(nums):
            r2 = random.uniform(30,85)
            pt1 = rg.Point3d(cnt.X + r1 * math.cos(rotation*num), cnt.Y + r1 * math.sin(rotation*num),0)
            pt2 = rg.Point3d(cnt.X + r2 * math.cos(rotation*num), cnt.Y + r2 * math.sin(rotation*num),0)
            pt2_plane = rg.Plane(pt2, rg.Vector3d.ZAxis)
            pt2_plane.Rotate(random.uniform(0,2), rg.Vector3d.ZAxis, pt2_plane.Origin)
            locations.append(pt2_plane)
            line = rg.Line(pt1, pt2)
            lines.append(line)
        return lines, locations
    
    def move_to_location(self):
        pass
    
    def floorplan_data(self):
        pass


floor = Floorplan(rooms, widths, depths, initial_room_idx, seed, origin)
floor.initialize()
initial_rooms = []
rooms_3d = []
for room in floor.rooms:
    room_3d,room_2d = room.visual_3d()
    initial_rooms.append(room_2d)
    rooms_3d.append(room_3d)
network = floor.network
floor_name = str(floor)
# ---------- end floorplan ----------
crv = Curve([<curve referenced from the Rhino model> x6])  # disabled
number_slider_4 = Slider(35, range=0..50)  # disabled
area = Area(Geometry=flatten(floorplan.initial_rooms))  # -> Area, Centroid; disabled
area_2 = Area(Geometry=crv)  # -> Area, Centroid; disabled
sort = SortList(Keys=area.Area, ValuesA=flatten(floorplan.initial_rooms))  # -> Keys, ValuesA; disabled
number_slider_5 = Slider(6, range=0..6)  # disabled
sort_2 = SortList(Keys=area_2.Area, ValuesA=crv)  # -> Keys, ValuesA; disabled
explode = Explode(Curve=floorplan.network, Recursive=True)  # -> Segments, flatten(Vertices); disabled
swatch = ColourSwatch(SwatchColor=RGB(217, 95, 105))  # disabled
swatch_2 = ColourSwatch(SwatchColor=RGB(242, 225, 141))  # disabled
swatch_3 = ColourSwatch(SwatchColor=RGB(242, 149, 68))  # disabled
swatch_4 = ColourSwatch(SwatchColor=RGB(239, 182, 242))  # disabled
swatch_5 = ColourSwatch(SwatchColor=RGB(191, 185, 155))  # disabled
swatch_6 = ColourSwatch(SwatchColor=RGB(242, 129, 119))  # disabled
boundary = BoundarySurfaces(Edges=sort_2.ValuesA)  # disabled
number_slider_6 = Slider(4.08, range=0..100)  # disabled
create_dash = GhPythonScript(crvs=floorplan.network, dash_num=number_slider_4)  # -> out, all_lines, all_pts; inputs crvs: list of Curve, dash_num: Int32; disabled
# ---------- create_dash: Python ----------
__author__ = "yanga"
__version__ = "2021.08.01"

import rhinoscriptsyntax as rs
import Rhino.Geometry as rg
import ghpythonlib.treehelpers as th


def get_end_start_pt(crvs):
    pts_start = []
    pts_end = []
    for crv in crvs:
        start = crv.PointAtStart
        end = crv.PointAtEnd
        pts_start.append(start)
        pts_end.append(end)
    return pts_start, pts_end

def dash_line(pts_end, pts_start, dash_num):
    all_pts = []
    all_lines = []
    if dash_num & 2 == 0:
        dash_num += 1
    for i in range(len(pts_end)):
        vec = rg.Vector3d(pts_start[i].X - pts_end[i].X, pts_start[i].Y - pts_end[i].Y, 0)
        pts = [pts_end[i]]
        for idx in range(1, dash_num):
            cur_vec = vec * idx / dash_num 
            pts.append(rg.Point3d(pts_end[i].X + cur_vec.X, pts_end[i].Y + cur_vec.Y, 0))
        pts.append(pts_start[i])
        all_pts.append(pts)
        
        lines = []

        for i in range(len(pts)):
            if i % 2 ==0:
                continue
            else:
                line = rg.Line(pts[i-1], pts[i])
                lines.append(line)
        all_lines.append(lines)
    return all_lines, all_pts

pts_start, pts_end = get_end_start_pt(crvs)
all_lines, all_pts = dash_line(pts_end, pts_start, dash_num)
all_lines = th.list_to_tree(all_lines)
all_pts = th.list_to_tree(all_pts)
# ---------- end create_dash ----------
pt_2 = Point(explode.Vertices)  # disabled
merge = Merge(Data1=swatch, Data2=swatch_2, Data3=swatch_5, Data4=swatch_6, Data5=swatch_3, Data6=swatch_4)  # disabled
boundary_2 = BoundarySurfaces(Edges=sort.ValuesA)  # disabled
series_2 = Series(Start=0, Step=1, Count=number_slider_5)  # disabled
swatch_7 = ColourSwatch(SwatchColor=RGB(138, 138, 138))  # disabled
number_slider_7 = Slider(2, range=0..10)  # disabled
cir = Circle(Plane=pt_2, Radius=1)  # disabled
pt_3 = Point(<point referenced from the Rhino model>)  # disabled
item_4 = ListItem(List=boundary, Index=series_2, Wrap=True)  # disabled
item_5 = ListItem(List=merge, Index=series_2, Wrap=True)  # disabled
swatch_8 = ColourSwatch(SwatchColor=RGB(0, 0, 0))  # disabled
swatch_9 = ColourSwatch(SwatchColor=RGB(3, 0, 0))  # disabled
swatch_10 = ColourSwatch(SwatchColor=RGB(138, 138, 138))  # disabled
item_6 = ListItem(List=boundary_2, Index=series_2, Wrap=True)  # disabled
previewlw = CustomPreviewLineweights(Geometry=floorplan.initial_rooms, Shader=swatch_7, Absolute=False)  # disabled
tag = TextTag3D(Location=pt_3, Text=floorplan.floor_name, Size=number_slider_6, Colour=swatch_9, Justification=7)  # disabled
preview = CustomPreview(Geometry=item_6, Material=item_5)  # disabled
previewlw_2 = CustomPreviewLineweights(Geometry=create_dash.all_lines, Shader=swatch_10, Thickness=number_slider_7, Absolute=False)  # disabled
previewlw_3 = CustomPreviewLineweights(Geometry=cir, Shader=swatch_8, Thickness=number_slider_7, Absolute=False)  # disabled
preview_2 = CustomPreview(Geometry=item_4, Material=item_5)  # disabled

# ----
series_3 = Series(Start=0, Step=1, Count=Slider(6, range=0..6))
crv_2 = Curve(<curve referenced from the Rhino model>)
crv_3 = Curve(<curve referenced from the Rhino model>)
pt_4 = Point(<point referenced from the Rhino model>)
test = GhPythonScript(crv1=crv_2, crv2=crv_3, plane=pt_4)  # -> out, a, c, b; inputs crv1: Curve, crv2: Curve, plane: Plane; disabled
# ---------- test: Python ----------
__author__ = "yanga"
__version__ = "2021.07.30"

import rhinoscriptsyntax as rs
import Rhino.Geometry as rg
import math
import random

def crv_dist(crv):
    pt1 = crv.PointAtEnd
    pt2 = crv.PointAtStart
    dist = math.sqrt((pt1.X - pt2.X)**2 + (pt1.Y - pt2.Y)**2)
    return dist

def create_ray(plane):
    origin = plane.Origin
    axis = plane.XAxis
    ray1 = rg.Line(origin, axis, 2).ToNurbsCurve()
    ray2 = rg.Line(origin, -axis, 2).ToNurbsCurve()
    rays = rg.Curve.JoinCurves([ray1, ray2])
    return rays

frame1 = crv1.PerpendicularFrameAt(crv_dist(crv1)/2)[1]
frame2 = crv2.PerpendicularFrameAt(crv_dist(crv2)/2)[1]


def distribution(nums,plane):
    cnt = plane.Origin
    lines = []
    r1 = 0
    r2 = random.uniform(10,20)
    rotation = random.uniform(1,nums) * math.pi / nums;
    for num in range(nums):
        pt1 = rg.Point3d( cnt.X + r1 * math.cos(rotation*num), cnt.Y + r1*math.sin(rotation*num),0)
        pt2 = rg.Point3d(cnt.X + r2 * math.cos(rotation*num), cnt.Y + r2*math.sin(rotation*num),0)
        line = rg.Line(pt1, pt2)
        lines.append(line)
    return lines




#a = create_ray(frame1)
a = distribution(5,plane)
# ---------- end test ----------
panel_2 = Panel("""livingroom
master_bedroom
guest_bedroom
kitchen
master_bath
guest_bath""")
width_2 = Panel("""30
20
20
15
15
10""")
depth_2 = Panel("""40
30
25
20
15
15""")
item_7 = ListItem(List=width_2, Index=series_3, Wrap=True)
item_8 = ListItem(List=depth_2, Index=series_3, Wrap=True)
item_9 = ListItem(List=panel_2, Index=series_3, Wrap=True)
pt_5 = Point(<point referenced from the Rhino model>)
room_2 = GhPythonScript()  # -> out, room; same code as room
pln_2 = Plane(pt_5)
floorplan_2 = GhPythonScript(
    room=room_2.room,
    rooms=item_9,
    widths=item_7,
    depths=item_8,
    initial_room_idx=Slider(0, range=0..5),
    origin=pln_2,
    seed=Slider(60, range=0..100))  # -> out, reset, on, network, initial_rooms, rooms_3d, floor_name; inputs rooms: list, widths: list, depths: list, initial_room_idx: Int32, origin: Plane; same code as floorplan
crv_4 = Curve(floorplan_2.initial_rooms)

# ---- group: Main Driver, needs to be replaced by a c# script to optimize the performance.
pulling = Pulling(programs=floorplan_2.initial_rooms, maxiterations=Slider(5000, range=0..5000))  # -> network, programs_2

# ----
crv_5 = Curve(floorplan_2.network)
crv_6 = Curve(pulling.network)

# ---- group: visualization
srf = Surface(pulling.programs_2)
crv_7 = Curve([<curve referenced from the Rhino model> x6])
area_3 = Area(Geometry=flatten(srf))  # -> Area, Centroid
area_4 = Area(Geometry=crv_7)  # -> Area, Centroid
debrep = DeconstructBrep(Brep=srf)  # -> Faces, Edges, Vertices
sort_3 = SortList(Keys=area_3.Area, ValuesA=flatten(srf))  # -> Keys, ValuesA
panel_3 = Panel("#F2B6C6")
sort_4 = SortList(Keys=area_4.Area, ValuesA=crv_7)  # -> Keys, ValuesA
explode_2 = Explode(Curve=crv_5, Recursive=True)  # -> Segments, flatten(Vertices)
boundary_3 = BoundarySurfaces(Edges=sort_4.ValuesA)
merge_2 = Merge(
    Data1=ColourSwatch(SwatchColor=RGB(217, 95, 105)),
    Data2=ColourSwatch(SwatchColor=RGB(242, 225, 141)),
    Data3=ColourSwatch(SwatchColor=RGB(191, 185, 155)),
    Data4=ColourSwatch(SwatchColor=RGB(242, 129, 119)),
    Data5=ColourSwatch(SwatchColor=RGB(242, 149, 68)),
    Data6=ColourSwatch(SwatchColor=RGB(239, 182, 242)))
create_dash_2 = GhPythonScript(crvs=crv_5, dash_num=Slider(35, range=0..50))  # -> out, all_lines, all_pts; inputs crvs: list of Curve, dash_num: Int32; same code as create_dash
pt_6 = Point(explode_2.Vertices)
number_slider_8 = Slider(1, range=0..10)
cir_2 = Circle(Plane=pt_6, Radius=1)
pt_7 = Point(<point referenced from the Rhino model>)
preview_3 = CustomPreview(Geometry=flatten(sort_3.ValuesA), Material=merge_2)
tag_2 = TextTag3D(
    Location=pt_7,
    Text=floorplan_2.floor_name,
    Size=Slider(4.08, range=0..100),
    Colour=ColourSwatch(SwatchColor=RGB(3, 0, 0)),
    Justification=7)
preview_4 = CustomPreview(Geometry=boundary_3, Material=merge_2)
previewlw_4 = CustomPreviewLineweights(Geometry=[crv_4, crv_6], Shader=ColourSwatch(SwatchColor=RGB(138, 138, 138)), Absolute=False)
previewlw_5 = CustomPreviewLineweights(Geometry=crv_7, Shader=ColourSwatch(SwatchColor=RGB(0, 0, 0)), Thickness=Slider(2, range=0..10), Absolute=False)
previewlw_6 = CustomPreviewLineweights(
    Geometry=create_dash_2.all_lines,
    Shader=ColourSwatch(SwatchColor=RGB(138, 138, 138)),
    Thickness=number_slider_8,
    Absolute=False)
previewlw_7 = CustomPreviewLineweights(Geometry=cir_2, Shader=ColourSwatch(SwatchColor=RGB(79, 79, 79)), Thickness=number_slider_8, Absolute=False)

# ==== cluster Pulling
maxiterations = ClusterInput()
programs = ClusterInput()  # programs
crv = Curve(programs)
cc = CurveCollide(Curves=crv, BasePlane=PlaneXY(0, 0, 0), Strength=1)  # -> Goal, Frames
pt = Point(cc.Frames)
inter = InterconnectPoints(Pts=pt)
length_line = LengthLine(Line=inter, Length=0, Strength=1e-05)
onplane = OnPlane(Points=pt, Plane=PlaneXY(0, 0, 0), Strength=10)
show = Show(G=cc.Frames)
entwine = Entwine(Branch00=[cc.Goal, length_line, onplane], Branch01=show, FlattenInputs=True)
zombiesolver = ZombieSolver(GoalObjects=entwine, Threshold=1e-10, Tolerance=0.01, MaxIterations=maxiterations)  # -> I, V, O
unflatten = UnflattenTree(Tree=zombiesolver.O, Guide=entwine)
bang = ExplodeTree(Data=unflatten)  # -> Branch0, Branch1
orient = Orient(Geometry=crv, Source=cc.Frames, Target=bang.Branch1)  # -> Geometry, Transform
programs_2 = ClusterOutput(orient.Geometry)  # Programs
network = ClusterOutput(zombiesolver.O)  # network
