# Grasshopper definition The Miscellaneous.gh (Grasshopper 1.0.7)
# plug-ins: Human

door_width = Slider(7, range=3..7)
wall = GhPythonScript()  # -> out, wall
# ---------- wall: Python ----------
__author__ = "yanga"
__version__ = "2021.08.18"

import rhinoscriptsyntax as rs
import Rhino.Geometry as rg
import math
import copy

class Wall:
    def __init__(self, name, edge, self_thickness, window_width, wall_seg_length, material, inside_target):
        
        self.name = name
        self.edge = edge
        self.self_thickness = self_thickness
        self.window_width = window_width
        self.wall_seg_length = wall_seg_length
        self.material = material
        self.inside_target = inside_target
        self.inside_dir = self.find_inside_dir(self.inside_target)
        self.outside_dir = self.find_outside_dir()
        self.has_door = False
        self.neighbors = {}
    
    def __repr__(self):
        return "Wall_id: " + str(self.name)
    
    def update_neighbors(self, wall):
        self.neighbors[wall.name] = wall
    
    @staticmethod
    def find_center(edge):
        x = (edge[0].X + edge[1].X) / 2
        y = (edge[0].Y + edge[1].Y) / 2
        cnt = rg.Point3d(x,y,0)
        return cnt
    
    def find_inside_dir(self, target):
        cnt = self.find_center(self.edge)
        dir = rg.Vector3d(target - cnt)
        dir.Unitize()
        return dir
    
    def find_outside_dir(self):
        outside_dir = self.inside_dir.Clone()
        outside_dir.Rotate(math.pi, rg.Vector3d.ZAxis)
        return outside_dir
    
    def divide_edge(self, edge):
        if isinstance(edge, list):
            edge = rg.Polyline(edge)
        start_pt = edge[0]
        end_pt = edge[1]
        edge_crv = rg.PolylineCurve(edge)
        ts = rg.Curve.DivideByCount(edge_crv, int(edge.Length / self.wall_seg_length), True)
        seg_pts = [edge_crv.PointAt(t) for t in ts]
        return seg_pts
    
    def slide_pt(self, target_pt, end_pt, offset_dist):
        dir = rg.Vector3d(end_pt - target_pt)
        dir.Unitize()
        end_pt = rg.Point3d(end_pt.X - dir.X * offset_dist, end_pt.Y - dir.Y * offset_dist, 0)
        return [target_pt, end_pt]
    
    def offset_edge(self, edges, offset_dist, closed):
        all_boundaries = []
        dir = self.inside_dir
        for edge in edges:
            pt1 = edge[0]
            pt2 = edge[1]
            pt3 = rg.Point3d(edge[1].X + dir.X * offset_dist, edge[1].Y + dir.Y * offset_dist, 0)
            pt4 = rg.Point3d(edge[0].X + dir.X * offset_dist, edge[0].Y + dir.Y * offset_dist, 0)
            if not closed:
                pts = [pt3, pt4]
            else:
                pts = [pt1, pt2, pt3, pt4, pt1]
            boundary = rg.PolylineCurve(pts)
            all_boundaries.append(boundary)
        return all_boundaries
        
    
    def offset_both_sides(self, pt, target_1, target_2, dist1, dist2):
        new_pt1 = self.slide_pt(target_1, pt, dist1)[-1]
        new_pt2 = self.slide_pt(target_2, pt, dist2)[-1]
        return [new_pt1, new_pt2]
    
    def create_window_edge(self, edges, touch_corner):
        window_edges = []
        count = 0
        for edge in edges:
            cur_win_edge = []
            cur_idx = count
            count += 1
            next_idx = count
            if cur_idx == len(edges)-1:
                break
            if cur_idx == len(edges)-2:
                cur_win_edge = [edges[cur_idx][1], edges[next_idx][1]]
            else:
                cur_win_edge = [edges[cur_idx][1], edges[next_idx][0]]
            window_edges.append(cur_win_edge)
        if not touch_corner:
            window_edges = window_edges[:-1]
        return window_edges
    
    def create_door_wall(self, doors, has_door, door_width):
        # create 2d wall and door representation
        edge_pts = self.edge
        edges_pts = []
        new_corner_pt_1 = self.slide_pt(edge_pts[1], edge_pts[0], self.self_thickness)[-1]
        new_corner_pt_2 = self.slide_pt(edge_pts[0], edge_pts[1], self.self_thickness)[-1]
        corner_stone_1 = [edge_pts[0], new_corner_pt_1]
        door_start = []
        door_end = []
        print edge_pts[0]
        # start pts
        edges_pts.extend(corner_stone_1)
        
        # create door here
        if doors:
            for i in range(len(doors)):
                if has_door[i]:
                    door_loc = doors[i]
                    door_corner_1 = self.slide_pt(edge_pts[0], door_loc, door_width/2)[-1]
                    door_corner_2 = self.slide_pt(edge_pts[1], door_loc, door_width/2)[-1]
                    edges_pts.append(door_corner_1)
                    door_start.append(door_corner_1)
                    edges_pts.append(door_corner_2)
                    door_end.append(door_corner_2)
        corner_stone_2 = [edge_pts[1], new_corner_pt_2]
        # end points
        edges_pts.extend(corner_stone_2)
        edges_pts.sort(key=lambda x: rg.Point3d.DistanceTo(x, edge_pts[0]))
        edges = []
        for pt_i in range(len(edges_pts)):
            cur_idx = pt_i
            next_idx = pt_i + 1
            pre_idx = pt_i - 1
            if cur_idx == len(edges_pts) - 1:
                continue
            elif edges_pts[cur_idx] in door_start:
                continue
            else:
                cur_edge = [edges_pts[cur_idx], edges_pts[next_idx]]
            edges.append(cur_edge)
        wall = self.offset_edge(edges, self.self_thickness/4, True)
        return wall
    
    def create_window_wall(self, win_touch_corner=True, win_double_lines=False):
        # create 2d wall and window representations
        edge_pts = self.divide_edge(self.edge)
        new_corner_pt_1 = self.slide_pt(edge_pts[-1], edge_pts[0], self.self_thickness)[-1]
        new_corner_pt_2 = self.slide_pt(edge_pts[0], edge_pts[-1], self.self_thickness)[-1]
        pt_pt_dist = rg.Point3d.DistanceTo(edge_pts[0], edge_pts[1])
        
        new_pts = copy.copy(edge_pts)
        new_pts[0] = new_corner_pt_1
        new_pts[-1] = new_corner_pt_2
        edges = [[edge_pts[0], new_corner_pt_1]]
        
        cur_window_w = self.window_width
        std_slide_dist = (pt_pt_dist - cur_window_w) / 2
        
        num_pts = len(new_pts)
        for idx in range(num_pts):
            cur_idx = idx
            if cur_idx == 0 or cur_idx == num_pts - 1:
                continue
            else:
                # excluding the corner points, if this is the first point encountering
                # shift cur_dist1 towards the first corner point, and standard distance to the next point
                if cur_idx == 1:
                    cur_dist1 = rg.Point3d.DistanceTo(new_pts[0], new_pts[cur_idx])
                    slide_dist1 = cur_dist1 - cur_window_w
                    slide_dist2 = std_slide_dist
                    new_edge = self.offset_both_sides(new_pts[cur_idx], new_pts[0], new_pts[2], slide_dist1, slide_dist2)
                
                # vice versa, if this is the last point, excluding the corner points.
                # shift cur_dist2 towards the last corner point, and standard distance to the previous point
                elif cur_idx == num_pts - 2:
                    cur_dist2 = rg.Point3d.DistanceTo(new_pts[-1], new_pts[cur_idx])
                    slide_dist1 = std_slide_dist
                    slide_dist2 = cur_dist2 - cur_window_w
                    new_edge = self.offset_both_sides(new_pts[cur_idx], new_pts[cur_idx-1], new_pts[-1], slide_dist1, slide_dist2)
                
                else:
                    new_edge = self.offset_both_sides(new_pts[cur_idx], new_pts[cur_idx-1], new_pts[cur_idx+1], std_slide_dist, std_slide_dist)
                edges.append(new_edge)
        # add the last corner point
        edges.append([edge_pts[-1], new_corner_pt_2])
        window_edges = self.create_window_edge(edges, win_touch_corner)
        window_edges = self.offset_edge(window_edges, self.self_thickness / 3, win_double_lines)
        wall = self.offset_edge(edges, self.self_thickness, True)
        return wall, window_edges



wall = Wall

""" TEST 
wall = Wall
test_wall = wall("test", edge, 3, 6, 10, "brick", target)
walls, windows = test_wall.create_wall()
"""
# ---------- end wall ----------
room = GhPythonScript(wall=wall.wall, wall_thickness=Slider(2, range=0.5..2), window_width=Slider(4.92, range=3..8), door_width=door_width)  # -> out, wall, room
# ---------- room: Python ----------
__author__ = "yanga"
__version__ = "2021.07.30"

import rhinoscriptsyntax as rs
import Rhino.Geometry as rg
import System.Drawing as sd
import ghpythonlib.treehelpers as th
import random
import math
import json


tol = 0.01

class Room:
    """ All rooms are considered closed rectangular shapes."""
    def __init__ (self, room_name, edge, id):
        self.room_name = room_name
        self.edge = edge
        self.id = id
        self.shared_wall_pts = None
        self.doors = []
        self.windows = []
        self.walls = []
        self.neighbor = {}
        
    def __repr__ (self):
        return "%s #%s"%(self.room_name, self.id)
    
    def area(self):
        area = rg.AreaMassProperties.Compute(rg.PolylineCurve(self.edge).Area)
        return area
    
    def location(self):
        loc = rg.Polyline(self.edge).CenterPoint()
        return loc
        
    def visual_3d(self, closed_poly, height):
        crv = closed_poly.ToNurbsCurve()
        result = rg.Extrusion.Create(crv, height, True)
        return result, crv
    
    def crv_dist(self, edge):
        pt1 = edge[0]
        pt2 = edge[1]
        dist = math.sqrt((pt1.X - pt2.X)**2 + (pt1.Y - pt2.Y)**2)
        return dist
    
    def explode_closed_poly(self, closed_poly):
        num_corners = len(closed_poly)
        edges = []
        for idx in range(num_corners):
            cur_idx = idx
            next_idx = idx + 1
            if cur_idx == num_corners - 1:
                break
            cur_edge = rg.Polyline([closed_poly[cur_idx], closed_poly[next_idx]])
            edges.append(cur_edge)
        return edges
        
    
    def update_neighbor(self, other_room, door_location):
        self.neighbor[str(other_room)] = {
            "room": other_room,
            "door_location": door_location
        }
    
    def has_partition_wall(self, edge, intersect_event_pt):
        cur_line = rg.Line(edge[0], edge[1])
        intersect = rg.Line.DistanceTo(cur_line, intersect_event_pt, True)
        intersect = round(intersect,3)
        if intersect == 0:
            return True
        else:
            return False
    
    def initialize_walls(self, shared_wall_pts, is_placed_door):
        room_2d = self.edge
        wall_edges = self.explode_closed_poly(room_2d)
        num_edges = len(wall_edges)
        walls = []
        windows = []
        inside_target = room_2d.CenterPoint()
        for idx in range(num_edges):
            doors =  []
            has_door = []
            is_partition_wall=False
            cur_wall = wall(self.room_name + " " + str(idx), wall_edges[idx], wall_thickness, window_width, 10, "brick", inside_target)
            # use the shared wall points to test ewhether this is a parition wall, once this is break out the loop, otherwise keep looping till the end
            if shared_wall_pts:
                for pt_idx in range(len(shared_wall_pts)):
                    door_loc = shared_wall_pts[pt_idx]
                    result = self.has_partition_wall(wall_edges[idx], door_loc)
                    # if this wall is a parition wall
                    if result == True:
                        # get the possible door locations
                        doors.append(door_loc)
                        # test whether there are any doors
                        has_door.append(is_placed_door[pt_idx])
                        is_partition_wall = True
            if is_partition_wall:
                cur_wall_2d = cur_wall.create_door_wall(doors, has_door, door_width)
            else:
                cur_wall_2d, window_2d = cur_wall.create_window_wall()
                windows.append(window_2d)
            walls.append(cur_wall_2d)
        self.windows = windows
        self.walls = walls


room = Room
wall = wall


#test_room = room("test", edges, 0)
#a, b = test_room.initialize_walls()
#a = th.list_to_tree(a)
#b = th.list_to_tree(b)
# ---------- end room ----------
panel = Panel("""Room_0
Room_1
Room_2""")
crv = Curve([<curve referenced from the Rhino model> x3])
run = GhPythonScript(wall=room.wall, room=room.room, edges=crv, names=panel)  # -> out, room_names, room_loc, all_walls, all_windows, paths; inputs edges: list of Polyline, names: list
# ---------- run: Python ----------
__author__ = "yanga"
__version__ = "2021.08.21"

import rhinoscriptsyntax as rs
import Rhino.Geometry as rg
import math
import ghpythonlib.treehelpers as th
import copy


def initialize_floor_plane(names, edges):
    rooms = []
    num_rooms = len(names)
    for i in range(num_rooms):
        cur_room = room(names[i], edges[i], i)
        rooms.append(cur_room)
    return rooms


def get_path(rooms):
    paths = []
    for cur_room in rooms:
        room_loc = cur_room.location()
        for neighbor in cur_room.neighbor:
            cur_neighbor = cur_room.neighbor[neighbor]
            if cur_neighbor["door_location"]:
                cur_path = rg.Line(room_loc, cur_neighbor["door_location"])
                paths.append(cur_path)
    return paths

def run(rooms):
    all_walls = []
    all_windows = []
    for i in range(len(rooms)):
        exist = False
        cur_room = rooms[i]
        cur_all_events = []
        is_placed_door = []
        for j in range(len(rooms)):
            if i == j:
                continue
            else:
                intersection = rg.Intersect.Intersection.CurveCurve(rg.PolylineCurve(rooms[i].edge), rg.PolylineCurve(rooms[j].edge), 0.01, 0.01)
                if intersection:
                    intx_end_pts = [intersection[0].PointA, intersection[0].PointA2]
                    cnt = wall.find_center(intx_end_pts)
                    cur_all_events.append(cnt)
                    inter_wall_width = rg.Point3d.DistanceTo(intx_end_pts[0],  intx_end_pts[1])
                    if inter_wall_width > 10:
                        is_placed_door.append(True)
                        door_location = cnt
                    else:
                        is_placed_door.append(False)
                        door_location = None
                    rooms[i].update_neighbor(rooms[j], door_location)
        cur_room.initialize_walls(cur_all_events, is_placed_door)
        all_walls.append(cur_room.walls)
        all_windows.append(cur_room.windows)
    return all_walls, all_windows


all_rooms = initialize_floor_plane(names,edges)
all_walls, all_windows = run(all_rooms)


paths = get_path(all_rooms)

all_walls = th.list_to_tree(all_walls)
all_windows = th.list_to_tree(all_windows)
room_loc = th.list_to_tree([room.location() for room in all_rooms])
room_names = th.list_to_tree(all_rooms)
# ---------- end run ----------
boundary = BoundarySurfaces(Edges=run.all_walls)
crv_2 = Curve(run.paths)
pt = Point(run.room_loc)
preview = CustomPreview(Geometry=boundary, Material=ColourSwatch(SwatchColor=RGB(0, 0, 0)))
previewlw = CustomPreviewLineweights(Geometry=crv_2, Shader=ColourSwatch(SwatchColor=RGB(255, 110, 0)), Thickness=Slider(4, range=0..10), Absolute=False)
previewlw_2 = CustomPreviewLineweights(
    Geometry=run.all_windows,
    Shader=ColourSwatch(SwatchColor=RGB(0, 0, 0)),
    Thickness=Slider(3, range=0..10),
    Absolute=False)
tag = TextTag(Location=pt, Text=run.room_names)
