# Grasshopper definition 2dTo3D.gh (Grasshopper 1.0.7)

# ---- group: Main Driver
contour_noise_tolerance = Slider(2500, range=1..5000)
image_selector = GhPythonScript(
    localhost_path="http://127.0.0.1:5000/",
    image_name=Slider(2, range=1..9),
    tolerance=Slider(253, range=0..300),
    min_size_per_pixel=Slider(1, range=1..10),
    contour_noise_tolerance=contour_noise_tolerance)  # -> out, image_path
# ---------- image_selector: Python ----------
__author__ = "yanga"
__version__ = "2022.01.23"

import rhinoscriptsyntax as rs


image_path = localhost_path + image_name + "/" + tolerance + "/" + min_size_per_pixel + "/" + contour_noise_tolerance
# ---------- end image_selector ----------
python = GhPythonScript(url=image_selector.image_path)  # -> out, coords, img_input_path
# ---------- python: Python ----------
__author__ = "yanga"
__version__ = "2021.06.19"

import rhinoscriptsyntax as rs
import urllib2
import json
import Rhino.Geometry as rg
import ghpythonlib.treehelpers as th


file = urllib2.urlopen(url)
resp = json.loads(file.read().decode('utf-8'))

all_pts= []
for contour in resp["data"]:
    pts = []
    for coord in contour:
        pt = rg.Point3d(coord[0], coord[1]*-1, 0)
        pts.append(pt)
    all_pts.append(pts)

coords = th.list_to_tree(all_pts)
img_input_path = resp["input_path"]
# ---------- end python ----------
panel = Panel(python.coords)
pline = PolyLine(Vertices=panel, Closed=True)
boundary = BoundarySurfaces(Edges=pline)
bbox = BoundingBox(Content=flatten(pline), Plane=PlaneXY(0, 0, 0), UnionBox=True)  # -> Box, Box_2
Z = UnitZ(Factor=Slider(300, range=0..1000))
walls = Extrude(Base=boundary, Direction=Z)
debrep = DeconstructBrep(Brep=walls)  # -> Faces, Edges, Vertices
area = Area(Geometry=flatten(debrep.Faces))  # -> Area, Centroid
pdecon = Deconstruct(Point=area.Centroid)  # -> XComponent, YComponent, ZComponent
sort = SortList(Keys=pdecon.ZComponent, ValuesA=area.Centroid)  # -> Keys, ValuesA
item = ListItem(List=sort.Keys, Index=-1, Wrap=True)
int = Integer(pdecon.ZComponent)
int_2 = Integer(item)
equals = Equality(FirstNumber=int, SecondNumber=int_2)  # -> Equality, Inequality
dispatch = Dispatch(List=flatten(debrep.Faces), DispatchPattern=equals.Equality)  # -> ListA, ListB
path = FilePath(python.img_input_path)
srf = Surface(dispatch.ListA)
img = ImportImage(File=path)
preview = CustomPreview(Geometry=bbox.Box, Material=ColourSwatch(SwatchColor=RGB(31, 31, 31)))
preview_2 = CustomPreview(Geometry=srf, Material=ColourSwatch(SwatchColor=RGB(255, 0, 0)))

# ---- group: Animation Only / All this is doing is to move the generated floor plan onto the image
number_slider = Slider(235, range=0..1000)  # disabled
pt = Point(flatten(panel))  # disabled
pdecon_2 = Deconstruct(Point=pt)  # -> XComponent, YComponent, ZComponent; disabled
sort_2 = SortList(Keys=pdecon_2.YComponent)  # -> Keys, ValuesA; disabled
item_2 = ListItem(List=sort_2.Keys, Index=0, Wrap=True)  # disabled
num = Number(expr("-x", item_2))  # disabled
number_slider_2 = Slider(1, range=0..10)  # disabled
addition = Addition(A=num, B=number_slider)  # disabled
Y = UnitY(Factor=addition)  # disabled
move = Move(Geometry=python.coords, Motion=Y)  # -> Geometry, Transform; disabled
Z_2 = UnitZ(Factor=number_slider_2)  # disabled
move_2 = Move(Geometry=move.Geometry, Motion=Z_2)  # -> Geometry, Transform; disabled

# ---- group: Animation Only / growing points, film clip
number_slider_3 = Slider(550, range=0..1000)  # disabled
pline_2 = PolyLine(Vertices=move_2.Geometry, Closed=True)  # disabled
number_slider_4 = Slider(2750, range=0..2750)  # disabled
divide = DivideCurve(Curve=pline_2, Count=number_slider_3, Kinks=False)  # -> Points, Tangents, Parameters; disabled
series = Series(Start=0, Step=1, Count=number_slider_4)  # disabled
item_3 = ListItem(List=flatten(divide.Points), Index=series, Wrap=True)  # disabled
number_slider_5 = Slider(1.5, range=0..10)  # disabled
swatch = ColourSwatch(SwatchColor=RGB(81, 255, 0))  # disabled
msphere = MeshSphere(Base=item_3, Radius=number_slider_5, UCount=10, VCount=20)  # disabled
mcol = MeshColours(Mesh=msphere, Colours=swatch)  # disabled

# ---- group: Animation Only / Growing Corners, film clip
number_slider_6 = Slider(117, range=0..117)  # disabled
pt_2 = Point(flatten(move_2.Geometry))  # disabled
series_2 = Series(Start=0, Step=1, Count=number_slider_6)  # disabled
item_4 = ListItem(List=pt_2, Index=series_2, Wrap=True)  # disabled
number_slider_7 = Slider(3, range=0..10)  # disabled
swatch_2 = ColourSwatch(SwatchColor=RGB(255, 0, 0))  # disabled
msphere_2 = MeshSphere(Base=item_4, Radius=number_slider_7, UCount=10, VCount=20)  # disabled
mcol_2 = MeshColours(Mesh=msphere_2, Colours=swatch_2)  # disabled

# ---- group: Animation Only / Growing Walls, film clip
number_slider_8 = Slider(550, range=0..550)  # disabled
pt_3 = Point(simplify(divide.Points))  # disabled
series_3 = Series(Start=0, Step=1, Count=number_slider_8)  # disabled
number_slider_9 = Slider(350, range=0..1000)  # disabled
item_5 = ListItem(List=pt_3, Index=series_3, Wrap=True)  # disabled
pline_3 = PolyLine(Vertices=item_5, Closed=False)  # disabled
Z_3 = UnitZ(Factor=number_slider_9)  # disabled
swatch_3 = ColourSwatch(SwatchColor=RGBA(106, 214, 79, 125))  # disabled
extr = Extrude(Base=pline_3, Direction=Z_3)  # disabled
preview_3 = CustomPreview(Geometry=extr, Material=swatch_3)  # disabled

# ---- group: Animation Only / suupporting texts, move this if necessary
python_2 = GhPythonScript()  # -> out, text; disabled
# ---------- python_2: Python ----------
__author__ = "yanga"
__version__ = "2022.01.23"

import rhinoscriptsyntax as rs

text = "Tolerance: A threshold value that restricts and only reserves the pixels \n that have sizes below that threshold.\nmin_size_per_pixel: Reserve the pixels whose sizes are above the minimum restriction.\ncontour_noies_tolerance: A threshold value that reserves continous pixels \n that have sizes above the threshold value."
# ---------- end python_2 ----------
number_slider_10 = Slider(24, range=0..100)  # disabled
pt_4 = Point(<point referenced from the Rhino model>)  # disabled
swatch_4 = ColourSwatch(SwatchColor=RGB(0, 0, 0))  # disabled
tag = TextTag3D(Location=pt_4, Text=python_2.text, Size=number_slider_10, Colour=swatch_4, Justification=7)  # disabled
